# Grasshopper definition grass_facade.gh (Grasshopper 1.0.8)
# plug-ins: Pufferfish, LunchBox

surface = Surface(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)  # disabled

# ----
# V1_Facade
tile_width_offset = Slider(0.036, range=0.004..0.1)
tile_column_count = Slider(8, range=5..30)
tile_row_count = Slider(12, range=5..20)
tile_width_depth = Slider(0.05, range=0.01..0.1)
grout_depth = Slider(0.005, range=0..0.01)
input_surface = Surface(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)
cluster = Cluster(
    relay=input_surface,
    ypsos=tile_column_count,
    platos=tile_row_count,
    platos_armou=tile_width_offset,
    paxos_plakakia=tile_width_depth,
    paxos_armos=grout_depth)  # -> result, result_2, result_3
panel = Panel(cluster.result)
custom_preview = CustomPreview(Geometry=cluster.result_2, Material=cluster.result_3)

input_surface_2 = Surface(<surface referenced from the Rhino model>)
brep_edges = BrepEdges(Brep=surface)  # -> flatten(Naked), Interior, NonManifold; disabled
number_slider = Slider(3, range=0..3)  # disabled
join_curves = JoinCurves(Curves=brep_edges.Naked, Preserve=False)  # disabled
ypsos = Slider(25, range=5..30)  # disabled
platos = Slider(10, range=5..20)  # disabled
platos_armou = Slider(0.005, range=0.004..0.1)  # disabled
length = Length(Curve=join_curves)  # disabled
reverse_surface_direction = ReverseSurfaceDirection(Surface=surface, ReverseOption=number_slider)  # disabled
sort_list = SortList(Keys=length)  # -> reverse(Keys), ValuesValuesA; disabled
list_item = ListItem(List=sort_list.Keys, Index=0, Wrap=True)  # disabled
quad_panels = QuadPanels(Surface=reverse_surface_direction, UDivisions=ypsos, VDivisions=platos)  # disabled
negative = Negative(Value=platos_armou)  # disabled
smaller_than = SmallerThan(FirstNumber=length, SecondNumber=list_item)  # -> SmallerThan, OrEqualTo; disabled
offset_curve = OffsetCurve(Curve=quad_panels, Distance=negative, Corners=1)  # disabled
dispatch = Dispatch(List=join_curves, DispatchPattern=invert(smaller_than.SmallerThan))  # -> ListA, ListB; disabled
multiplication = Multiplication(A=platos_armou, B=2)  # disabled
curve = Curve(dispatch.ListB)  # disabled
surface_2 = Surface(offset_curve)  # disabled
offset_curve_2 = OffsetCurve(Curve=curve, Distance=multiplication, Corners=1)  # -> flatten(Curve); disabled
region_difference = RegionDifference(CurvesA=surface_2, CurvesB=offset_curve_2)  # disabled
surface_split = SurfaceSplit(Surface=surface, Curves=flatten(region_difference))  # disabled
area = Area(Geometry=surface_split)  # -> Area, Centroid; disabled
sort_list_2 = SortList(Keys=area.Area)  # -> reverse(Keys), ValuesValuesA; disabled
deconstruct_rectangle = DeconstructRectangle(Rectangle=dispatch.ListA)  # -> BasePlane, XInterval, YInterval; disabled
surface_3 = Surface(region_difference)  # disabled
list_item_2 = ListItem(List=sort_list_2.Keys, Index=0, Wrap=True)  # disabled
platos_2 = Number(deconstruct_rectangle.XInterval)  # disabled
ypsos_2 = Number(deconstruct_rectangle.YInterval)  # disabled
flip = Flip(Surface=surface_3)  # -> Surface, Result; disabled
smaller_than_2 = SmallerThan(FirstNumber=sort_list_2.Keys, SecondNumber=list_item_2)  # -> SmallerThan, OrEqualTo; disabled
panel_2 = Panel("platos_")  # disabled
panel_3 = Panel("/ypsos_")  # disabled
division = Division(A=platos_2, B=platos)  # disabled
division_2 = Division(A=ypsos_2, B=ypsos)  # disabled
paxos_plakakia = Slider(0.03, range=0.01..0.1)  # disabled
paxos_armos = Slider(0.01, range=0..0.01)  # disabled
concatenate = Concatenate(FragmentA=panel_2, FragmentB=division)  # disabled
concatenate_2 = Concatenate(FragmentA=panel_3, FragmentB=division_2)  # disabled
dispatch_2 = Dispatch(List=surface_split, DispatchPattern=smaller_than_2.SmallerThan)  # -> ListA, ListB; disabled
concatenate_3 = Concatenate(FragmentA=concatenate, FragmentB=concatenate_2)  # disabled
panel_4 = Panel(concatenate_3)  # disabled
armos = Data(dispatch_2.ListB)  # disabled
offset_surface = OffsetSurface(Surface=flip.Surface, Distance=paxos_plakakia, BothSides=0, CreateSolid=True)  # disabled
offset_surface_2 = OffsetSurface(Surface=armos, Distance=paxos_armos, BothSides=0, CreateSolid=True)  # disabled
colour_swatch = ColourSwatch(SwatchColor=RGB(128, 128, 128))  # disabled
colour_swatch_2 = ColourSwatch(SwatchColor=RGB(0, 0, 0))  # disabled
entwine = Entwine(Branch00=offset_surface, Branch01=offset_surface_2, FlattenInputs=True)  # disabled
entwine_2 = Entwine(Branch00=colour_swatch, Branch01=colour_swatch_2, FlattenInputs=True)  # disabled
custom_preview_2 = CustomPreview(Geometry=entwine, Material=entwine_2)  # disabled

# ==== cluster Cluster
platos_armou = ClusterInput()
paxos_plakakia = ClusterInput()
platos = ClusterInput()
paxos_armos = ClusterInput()
ypsos = ClusterInput()
platos_armou_2 = Number(platos_armou)
paxos_plakakia_2 = Number(paxos_plakakia)
platos_2 = Number(platos)
paxos_armos_2 = Number(paxos_armos)
ypsos_2 = Number(ypsos)
relay = ClusterInput()
brep_edges = BrepEdges(Brep=relay)  # -> flatten(Naked), Interior, NonManifold
rotate_2states = Number(Slider(3, range=2..3))
join_curves = JoinCurves(Curves=brep_edges.Naked, Preserve=False)
rotate_2states_2 = Number(rotate_2states)
length = Length(Curve=join_curves)
reverse_surface_direction = ReverseSurfaceDirection(Surface=relay, ReverseOption=rotate_2states_2)
sort_list = SortList(Keys=length)  # -> reverse(Keys), ValuesValuesA
platos_armou_3 = Number(platos_armou_2)
ypsos_3 = Number(ypsos_2)
platos_3 = Number(platos_2)
list_item = ListItem(List=sort_list.Keys, Index=0, Wrap=True)
quad_panels = QuadPanels(Surface=reverse_surface_direction, UDivisions=ypsos_3, VDivisions=platos_3)
negative = Negative(Value=platos_armou_3)
smaller_than = SmallerThan(FirstNumber=length, SecondNumber=list_item)  # -> SmallerThan, OrEqualTo
offset_curve = OffsetCurve(Curve=quad_panels, Distance=negative, Corners=1)
dispatch = Dispatch(List=join_curves, DispatchPattern=invert(smaller_than.SmallerThan))  # -> ListA, ListB
multiplication = Multiplication(A=platos_armou_3, B=2)
curve = Curve(dispatch.ListB)
surface = Surface(offset_curve)
offset_curve_2 = OffsetCurve(Curve=curve, Distance=multiplication, Corners=1)  # -> flatten(Curve)
region_difference = RegionDifference(CurvesA=surface, CurvesB=offset_curve_2)
deconstruct_rectangle = DeconstructRectangle(Rectangle=dispatch.ListA)  # -> BasePlane, XInterval, YInterval
surface_2 = Surface(region_difference)
platos_4 = Number(deconstruct_rectangle.XInterval)
ypsos_4 = Number(deconstruct_rectangle.YInterval)
flip = Flip(Surface=surface_2)  # -> Surface, Result
division = Division(A=platos_4, B=platos_3)
division_2 = Division(A=ypsos_4, B=ypsos_3)
concatenate = Concatenate(FragmentA="platos_", FragmentB=division)
concatenate_2 = Concatenate(FragmentA="/ypsos_", FragmentB=division_2)
paxos_plakakia_3 = Number(paxos_plakakia_2)
paxos_armos_3 = Number(paxos_armos_2)

# ---- group: armos
surface_split = SurfaceSplit(Surface=relay, Curves=flatten(region_difference))
area = Area(Geometry=surface_split)  # -> Area, Centroid
sort_list_2 = SortList(Keys=area.Area)  # -> reverse(Keys), ValuesValuesA
list_item_2 = ListItem(List=sort_list_2.Keys, Index=0, Wrap=True)
smaller_than_2 = SmallerThan(FirstNumber=sort_list_2.Keys, SecondNumber=list_item_2)  # -> SmallerThan, OrEqualTo
dispatch_2 = Dispatch(List=surface_split, DispatchPattern=smaller_than_2.SmallerThan)  # -> ListA, ListB
armos = Data(dispatch_2.ListB)
offset_surface = OffsetSurface(Surface=armos, Distance=paxos_armos_3, BothSides=0, CreateSolid=True)

# ----
concatenate_3 = Concatenate(FragmentA=concatenate, FragmentB=concatenate_2)
offset_surface_2 = OffsetSurface(Surface=flip.Surface, Distance=paxos_plakakia_3, BothSides=0, CreateSolid=True)
result = ClusterOutput(concatenate_3)

entwine = Entwine(Branch00=offset_surface_2, Branch01=offset_surface, FlattenInputs=True)
entwine_2 = Entwine(
    Branch00=ColourSwatch(SwatchColor=RGB(128, 128, 128)),
    Branch01=ColourSwatch(SwatchColor=RGB(0, 0, 0)),
    FlattenInputs=True)

result_2 = ClusterOutput(entwine)
result_3 = ClusterOutput(entwine_2)
