# Grasshopper definition Grass_Laser cut.gh (Grasshopper 1.0.8)
# plug-ins: OpenNest

spacing = Slider(0.6, range=0..1)

geometry_pipeline = GeometryPipeline(
    GroupByLayer=False,
    GroupByType=False,
    IncludeHidden=True,
    IncludeLocked=True,
    LayerFilter="*5mm",
    NameFilter="*",
    SublayerFiltering=True,
    TypeFilter=1073741848)
_5mm = Brep(graft(geometry_pipeline))
deconstruct_brep = DeconstructBrep(Brep=_5mm)  # -> Faces, Edges, Vertices
area = Area(Geometry=deconstruct_brep.Faces)  # -> Area, Centroid
sort_list = SortList(Keys=area.Area, ValuesValuesA=deconstruct_brep.Faces)  # -> reverse(Keys), reverse(ValuesValuesA)
xy_plane = XYPlane(Origin=Point(2415.948873, -6109.94682, 91.13657396))  # -> graft(Plane)
list_item = ListItem(List=sort_list.ValuesValuesA, Index="0", Wrap=True)
is_planar = IsPlanar(Surface=list_item, Interior=True)  # -> Planar, Plane
plane = Plane(is_planar.Plane)
orient = Orient(Geometry=_5mm, Source=plane, Target=xy_plane)  # -> Geometry, Transform
maketoxarto_70_100 = Curve(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)
opennest = OpenNest(
    Sheets=maketoxarto_70_100,
    Geo=flatten(orient.Geometry),
    Spacing=spacing,
    Placement=1,
    Tolerance=0.1,
    Rotations=4,
    Iterations=1,
    Seed=1,
    Reset=True,
    Run=Toggle(True))  # -> Sheets, Geo, ID, Transform, IDS

geometry_pipeline_2 = GeometryPipeline(
    GroupByLayer=False,
    GroupByType=False,
    IncludeHidden=True,
    IncludeLocked=True,
    LayerFilter="*3mm",
    NameFilter="*",
    SublayerFiltering=True,
    TypeFilter=1073741848)
_3mm = Brep(graft(geometry_pipeline_2))
deconstruct_brep_2 = DeconstructBrep(Brep=_3mm)  # -> Faces, Edges, Vertices
area_2 = Area(Geometry=deconstruct_brep_2.Faces)  # -> Area, Centroid
sort_list_2 = SortList(Keys=area_2.Area, ValuesValuesA=deconstruct_brep_2.Faces)  # -> reverse(Keys), reverse(ValuesValuesA)
list_item_2 = ListItem(List=sort_list_2.ValuesValuesA, Index="0", Wrap=True)
xy_plane_2 = XYPlane(Origin=Point(2415.948873, -6109.94682, 91.13657396))  # -> graft(Plane)
is_planar_2 = IsPlanar(Surface=list_item_2, Interior=True)  # -> Planar, Plane
plane_2 = Plane(is_planar_2.Plane)
orient_2 = Orient(Geometry=_3mm, Source=plane_2, Target=xy_plane_2)  # -> Geometry, Transform
maketoxarto_70_100_2 = Curve(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)
opennest_2 = OpenNest(
    Sheets=maketoxarto_70_100_2,
    Geo=flatten(orient_2.Geometry),
    Spacing=spacing,
    Placement=1,
    Tolerance=0.1,
    Rotations=4,
    Iterations=1,
    Seed=1,
    Reset=True,
    Run=Toggle(True))  # -> Sheets, Geo, ID, Transform, IDS

geometry_pipeline_3 = GeometryPipeline(
    GroupByLayer=False,
    GroupByType=False,
    IncludeHidden=True,
    IncludeLocked=True,
    LayerFilter="*2mm",
    NameFilter="*",
    SublayerFiltering=True,
    TypeFilter=1073741848)
_2mm = Brep(graft(geometry_pipeline_3))
deconstruct_brep_3 = DeconstructBrep(Brep=_2mm)  # -> Faces, Edges, Vertices
area_3 = Area(Geometry=deconstruct_brep_3.Faces)  # -> Area, Centroid
sort_list_3 = SortList(Keys=area_3.Area, ValuesValuesA=deconstruct_brep_3.Faces)  # -> reverse(Keys), reverse(ValuesValuesA)
list_item_3 = ListItem(List=sort_list_3.ValuesValuesA, Index="0", Wrap=True)
xy_plane_3 = XYPlane(Origin=Point(2415.948873, -6109.94682, 91.13657396))  # -> graft(Plane)
is_planar_3 = IsPlanar(Surface=list_item_3, Interior=True)  # -> Planar, Plane
plane_3 = Plane(is_planar_3.Plane)
orient_3 = Orient(Geometry=_2mm, Source=plane_3, Target=xy_plane_3)  # -> Geometry, Transform
maketoxarto_70_100_3 = Curve(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)
opennest_3 = OpenNest(
    Sheets=maketoxarto_70_100_3,
    Geo=flatten(orient_3.Geometry),
    Spacing=spacing,
    Placement=1,
    Tolerance=0.1,
    Rotations=4,
    Iterations=1,
    Seed=1,
    Reset=True,
    Run=Toggle(True))  # -> Sheets, Geo, ID, Transform, IDS

geometry_pipeline_4 = GeometryPipeline(
    GroupByLayer=False,
    GroupByType=False,
    IncludeHidden=True,
    IncludeLocked=True,
    LayerFilter="*1mm",
    NameFilter="*",
    SublayerFiltering=True,
    TypeFilter=1073741848)
_5mm_2 = Brep(graft(geometry_pipeline_4))
deconstruct_brep_4 = DeconstructBrep(Brep=_5mm_2)  # -> Faces, Edges, Vertices
area_4 = Area(Geometry=deconstruct_brep_4.Faces)  # -> Area, Centroid
sort_list_4 = SortList(Keys=area_4.Area, ValuesValuesA=deconstruct_brep_4.Faces)  # -> reverse(Keys), reverse(ValuesValuesA)
list_item_4 = ListItem(List=sort_list_4.ValuesValuesA, Index="0", Wrap=True)
xy_plane_4 = XYPlane(Origin=Point(2415.948873, -6109.94682, 91.13657396))  # -> graft(Plane)
is_planar_4 = IsPlanar(Surface=list_item_4, Interior=True)  # -> Planar, Plane
plane_4 = Plane(is_planar_4.Plane)
orient_4 = Orient(Geometry=_5mm_2, Source=plane_4, Target=xy_plane_4)  # -> Geometry, Transform
maketoxarto_70_100_4 = Curve(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)
opennest_4 = OpenNest(
    Sheets=maketoxarto_70_100_4,
    Geo=flatten(orient_4.Geometry),
    Spacing=spacing,
    Placement=1,
    Tolerance=0.1,
    Rotations=4,
    Iterations=1,
    Seed=1,
    Reset=True,
    Run=Toggle(True))  # -> Sheets, Geo, ID, Transform, IDS
