# Grasshopper definition grass_roof.gh (Grasshopper 1.0.8)
# plug-ins: Pufferfish, OpenNest, LunchBox

surface = Surface(graft([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]))  # disabled
surface_2 = Surface(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)  # disabled
merge = Merge(Data1=surface, Data2=surface_2)  # -> simplify(flatten(Result)); disabled
list_item = ListItem(List=flatten(surface_2), Index=0, Wrap=True)  # disabled
x_ksila = Slider(5, range=0..10)  # disabled
y_ksila = Slider(4, range=0..10)  # disabled
surface_3 = Surface(graft(merge))  # disabled
number_slider = Slider(0.3, range=0.1..2)  # disabled
number_slider_2 = Slider(0.2, range=0.1..1)  # disabled
number_slider_3 = Slider(0.6, range=0.1..1)  # disabled
number_slider_4 = Slider(3, range=2..3.5)  # disabled
panel = Panel("1")  # disabled
addition = Addition(A=x_ksila, B=1)  # disabled
addition_2 = Addition(A=y_ksila, B=1)  # disabled
ypsos_orofis = Number(number_slider)  # disabled
platos_tixos = Number(number_slider_2)  # disabled
offset = Number(number_slider_3)  # disabled
ypsos_tixos = Number(number_slider_4)  # disabled
divide_domain² = DivideDomain²(Domain=surface_3, UCount=x_ksila, VCount=panel)  # disabled
divide_domain²_2 = DivideDomain²(Domain=surface_3, UCount=panel, VCount=y_ksila)  # disabled
ypsos_orofis_2 = Number(ypsos_orofis)  # disabled

# ----
# Version_1
number_slider_5 = Slider(0.4, range=0..1)
input_surface = Surface([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])
cluster = Cluster(
    input_surface=input_surface,
    u_beam_count=Slider(5, range=0..10),
    v_beam_count=Slider(6, range=0..10),
    u_beam_length_reduction=Slider(0.3, range=0..1),
    u_beam_height=number_slider_5,
    v_beam_length_reduction=Slider(0.4, range=0..1),
    v_beam_height=Slider(0.2, range=0..1),
    u_beam_width=Slider(0.1, range=0.05..0.15),
    v_beam_width=Slider(0.11, range=0.05..0.15),
    uv_beam_overlap=Slider(0.09, range=0..0.1),
    ceiling_height=Slider(0.3, range=0.1..2),
    wall_thickness=Slider(0.2, range=0.1..1),
    wall_edge_offset=Slider(0.6, range=0.1..1),
    wall_height=Slider(3, range=2..3.5))  # -> result_2, result
custom_preview = CustomPreview(Geometry=cluster.result_2, Material=cluster.result)

unit_z = UnitZ(Factor=ypsos_orofis_2)  # disabled
isotrim = Isotrim(Surface=surface_3, Domain=divide_domain²)  # disabled
isotrim_2 = Isotrim(Surface=surface_3, Domain=divide_domain²_2)  # disabled
surface_points = SurfacePoints(Surface=surface_3)  # -> Points, Weights, Greville, UCount, VCount; disabled
extrude = Extrude(Base=surface_3, Direction=unit_z)  # disabled
perigrama_crv = Curve(surface_3)  # disabled
offset_2 = Number(offset)  # disabled
platos_tixos_2 = Number(platos_tixos)  # disabled

explode = Explode(Curve=isotrim, Recursive=True)  # -> Segments, Vertices; disabled
length = Length(Curve=explode.Segments)  # disabled
sort_list = SortList(Keys=length, ValuesValuesA=explode.Segments)  # -> Keys, reverse(ValuesValuesA); disabled
list_item_2 = ListItem(List=sort_list.ValuesValuesA, Index=0, Wrap=True)  # -> Item, Item1; disabled
curve = Curve(flatten([list_item_2.Item1, list_item_2.Item]))  # disabled
curve_middle = CurveMiddle(Curve=curve)  # disabled
cull_duplicates = CullDuplicates(Points=curve_middle, Tolerance=0.1, CullMode=3)  # -> Points, Indices, Valence; disabled
closest_point = ClosestPoint(Point=cull_duplicates.Points, Cloud=curve_middle)  # -> ClosestPoint, CPIndex, Distance; disabled
list_item_3 = ListItem(List=curve, Index=closest_point.CPIndex, Wrap=True)  # disabled

explode_2 = Explode(Curve=isotrim_2, Recursive=True)  # -> Segments, Vertices; disabled
length_2 = Length(Curve=explode_2.Segments)  # disabled
sort_list_2 = SortList(Keys=length_2, ValuesValuesA=explode_2.Segments)  # -> Keys, reverse(ValuesValuesA); disabled
list_item_4 = ListItem(List=sort_list_2.ValuesValuesA, Index=0, Wrap=True)  # -> Item, Item1; disabled
curve_2 = Curve(flatten([list_item_4.Item1, list_item_4.Item]))  # disabled
curve_middle_2 = CurveMiddle(Curve=curve_2)  # disabled
cull_duplicates_2 = CullDuplicates(Points=curve_middle_2, Tolerance=0.1, CullMode=3)  # -> Points, Indices, Valence; disabled
closest_point_2 = ClosestPoint(Point=cull_duplicates_2.Points, Cloud=curve_middle_2)  # -> ClosestPoint, CPIndex, Distance; disabled
list_item_5 = ListItem(List=curve_2, Index=closest_point_2.CPIndex, Wrap=True)  # disabled

offset_on_srf = OffsetOnSrf(Curve=perigrama_crv, Distance=offset_2, Surface=surface_3)  # disabled
deconstruct_brep = DeconstructBrep(Brep=surface_3)  # -> Faces, Edges, Vertices; disabled

# ----
# OPEN_NEST
# LASERCUT_
number_slider_6 = Slider(70, range=0..100)
input_geometry = Data(cluster.result_2)
cluster_2 = Cluster_2(data=input_geometry, sheet_x=number_slider_6, sheet_y=Slider(100, range=0..100), spacing=Slider(0.5, range=0..1))  # -> _70_100_crv_2, laser_2, id_2
_70_100_crv = Curve(cluster_2._70_100_crv_2)
laser = Curve(cluster_2.laser_2)
id = Curve(cluster_2.id_2)

offset_on_srf_2 = OffsetOnSrf(Curve=offset_on_srf, Distance=platos_tixos_2, Surface=surface_3)  # disabled
deconstruct = Deconstruct(Point=deconstruct_brep.Vertices)  # -> XComponent, YComponent, ZComponent; disabled
merge_2 = Merge(Data1=simplify(offset_on_srf_2), Data2=simplify(offset_on_srf))  # disabled
sort_list_3 = SortList(Keys=deconstruct.ZComponent, ValuesValuesA=deconstruct_brep.Vertices)  # -> Keys, ValuesValuesA; disabled
list_item_6 = ListItem(List=sort_list_3.ValuesValuesA, Index=0, Wrap=True)  # disabled
xy_plane = XYPlane(Origin=list_item_6)  # disabled
project = Project(Geometry=merge_2, Plane=xy_plane)  # -> Geometry, Transform; disabled
ypsos_tixos_2 = Number(ypsos_tixos)  # disabled
negative = Negative(Value=ypsos_tixos_2)  # disabled
unit_z_2 = UnitZ(Factor=negative)  # disabled
move = Move(Geometry=project.Geometry, Motion=unit_z_2)  # -> Geometry, Transform; disabled
merge_3 = Merge(Data1=simplify(move.Geometry), Data2=reverse(simplify(merge_2)))  # disabled
boolean_toggle = BooleanToggle(True)  # disabled
partition_list = PartitionList(List=list_item_3, Size=addition)  # disabled
partition_list_2 = PartitionList(List=list_item_5, Size=addition_2)  # disabled
panel_2 = Panel("3")  # disabled
number_slider_7 = Slider(0.3, range=0..1)  # disabled
number_slider_8 = Slider(0.3, range=0..1)  # disabled
number_slider_9 = Slider(0.4, range=0..1)  # disabled
number_slider_10 = Slider(0.2, range=0..1)  # disabled
loft_options = LoftOptions(Closed=boolean_toggle, Adjust=False, Rebuild=0, Refit=0, Type=panel_2)  # disabled
panel_3 = Panel("2")  # disabled
loft = Loft(Curves=merge_3, Options=loft_options)  # disabled
negative_2 = Negative(Value=number_slider_7)  # disabled
ipsos_x = Number(number_slider_8)  # disabled
ipsos_y = Number(number_slider_10)  # disabled
panel_4 = Panel("2")  # disabled
ipsos_x_2 = Number(ipsos_x)  # disabled
ipsos_y_2 = Number(ipsos_y)  # disabled
negative_3 = Negative(Value=number_slider_9)  # disabled
extend_curve = ExtendCurve(Curve=partition_list, Type=panel_3, Start=negative_2, End=negative_2)  # disabled
negative_4 = Negative(Value=ipsos_x_2)  # disabled
negative_5 = Negative(Value=ipsos_y_2)  # disabled
extend_curve_2 = ExtendCurve(Curve=partition_list_2, Type=panel_4, Start=negative_3, End=negative_3)  # disabled
unit_z_3 = UnitZ(Factor=negative_4)  # disabled
unit_z_4 = UnitZ(Factor=negative_5)  # disabled
extrude_2 = Extrude(Base=extend_curve, Direction=unit_z_3)  # disabled
extrude_3 = Extrude(Base=extend_curve_2, Direction=unit_z_4)  # disabled
number_slider_11 = Slider(0.1, range=0.05..0.15)  # disabled
number_slider_12 = Slider(0.07, range=0.05..0.15)  # disabled
platos_x = Number(number_slider_11)  # disabled
platos_y = Number(number_slider_12)  # disabled
platos_x_2 = Number(platos_x)  # disabled
platos_y_2 = Number(platos_y)  # disabled
division = Division(A=platos_x_2, B=2)  # disabled
division_2 = Division(A=platos_y_2, B=2)  # disabled
negative_6 = Negative(Value=division)  # disabled
negative_7 = Negative(Value=division_2)  # disabled
offset_surface = OffsetSurface(Surface=extrude_2, Distance=division, BothSides=negative_6, CreateSolid=True)  # -> simplify(Offset); disabled
offset_surface_2 = OffsetSurface(Surface=extrude_3, Distance=division_2, BothSides=negative_7, CreateSolid=True)  # -> simplify(Offset); disabled
unflatten_tree = UnflattenTree(Tree=flatten(offset_surface), Guide=extrude_2)  # disabled
unflatten_tree_2 = UnflattenTree(Tree=flatten(offset_surface_2), Guide=extrude_3)  # disabled
number_slider_13 = Slider(0.06, range=0..0.1)  # disabled
list_item_7 = ListItem(List=surface_points.Points, Index=0, Wrap=True)  # disabled
area = Area(Geometry=unflatten_tree_2)  # -> Area, Centroid; disabled
negative_8 = Negative(Value=number_slider_13)  # disabled
area_2 = Area(Geometry=unflatten_tree)  # -> Area, Centroid; disabled
distance = Distance(PointA=list_item_7, PointB=area.Centroid)  # disabled
distance_2 = Distance(PointA=list_item_7, PointB=area_2.Centroid)  # disabled
unit_z_5 = UnitZ(Factor=negative_8)  # disabled
sort_list_4 = SortList(Keys=distance, ValuesValuesA=unflatten_tree_2)  # -> Keys, ValuesValuesA; disabled
sort_list_5 = SortList(Keys=distance_2, ValuesValuesA=unflatten_tree)  # -> Keys, ValuesValuesA; disabled
move_2 = Move(Geometry=sort_list_5.ValuesValuesA, Motion=unit_z_5)  # -> Geometry, Transform; disabled
panel_5 = Panel("""-1
0""")  # disabled
panel_6 = Panel("""-1
0""")  # disabled
cull_index = CullIndex(List=sort_list_4.ValuesValuesA, Indices=panel_5, Wrap=True)  # disabled
cull_index_2 = CullIndex(List=move_2.Geometry, Indices=panel_6, Wrap=True)  # -> graft(List); disabled
solid_difference = SolidDifference(BrepsA=cull_index_2, BrepsB=flatten(cull_index))  # disabled
trim_tree = TrimTree(Tree=solid_difference, Depth=1)  # disabled
merge_4 = Merge(Data1=trim_tree, Data2=cull_index)  # disabled
solid_difference_2 = SolidDifference(BrepsA=simplify(loft), BrepsB=simplify(merge_4))  # disabled
colour_swatch = ColourSwatch(SwatchColor=RGB(194, 184, 163))  # disabled
colour_swatch_2 = ColourSwatch(SwatchColor=RGB(255, 105, 105))  # disabled
colour_swatch_3 = ColourSwatch(SwatchColor=RGB(135, 140, 93))  # disabled
colour_swatch_4 = ColourSwatch(SwatchColor=RGB(98, 66, 173))  # disabled
entwine = Entwine(Branch00=trim_tree, Branch01=cull_index, Branch02=extrude, Branch03=solid_difference_2, FlattenInputs=True)  # disabled
entwine_2 = Entwine(Branch00=colour_swatch, Branch01=colour_swatch_2, Branch02=colour_swatch_3, Branch03=colour_swatch_4, FlattenInputs=True)  # disabled
custom_preview_2 = CustomPreview(Geometry=entwine, Material=entwine_2)  # disabled

# ---- group: OPEN_NEST
number_slider_14 = Slider(70, range=0..100)  # disabled
number_slider_15 = Slider(100, range=0..100)  # disabled
number_slider_16 = Slider(0.5, range=0..1)  # disabled
data = Data(entwine)  # disabled
explode_tree = ExplodeTree(Data=data)  # -> Branch0, Branch1, Branch2; disabled
sheet_x = Number(number_slider_14)  # disabled
sheet_y = Number(number_slider_15)  # disabled
spacing = Number(number_slider_16)  # disabled
merge_5 = Merge(Data1=explode_tree.Branch0, Data2=explode_tree.Branch1)  # disabled
brep = Brep(flatten(merge_5))  # disabled
brep_2 = Brep(flatten(explode_tree.Branch2))  # disabled
deconstruct_brep_2 = DeconstructBrep(Brep=brep)  # -> Faces, Edges, Vertices; disabled
deconstruct_brep_3 = DeconstructBrep(Brep=brep_2)  # -> Faces, Edges, Vertices; disabled
area_3 = Area(Geometry=deconstruct_brep_2.Faces)  # -> Area, Centroid; disabled
area_4 = Area(Geometry=deconstruct_brep_3.Faces)  # -> Area, Centroid; disabled
sort_list_6 = SortList(Keys=area_3.Area, ValuesValuesA=deconstruct_brep_2.Faces)  # -> Keys, reverse(ValuesValuesA); disabled
sort_list_7 = SortList(Keys=area_4.Area, ValuesValuesA=deconstruct_brep_3.Faces)  # -> Keys, reverse(ValuesValuesA); disabled
list_item_8 = ListItem(List=sort_list_6.ValuesValuesA, Index=0, Wrap=True)  # disabled
unroll_brep = UnrollBrep(Brep=list_item_8, JoinUnrolled=False)  # disabled
list_item_9 = ListItem(List=sort_list_7.ValuesValuesA, Index=0, Wrap=True)  # disabled
unroll_brep_2 = UnrollBrep(Brep=list_item_9, JoinUnrolled=False)  # disabled
panel_7 = Panel("3")  # disabled
populate_geometry = PopulateGeometry(Geometry=unroll_brep, Count=panel_7, Seed=1)  # disabled
list_item_10 = ListItem(List=populate_geometry, Index=0, Wrap=True)  # -> Item, Item1, Item2; disabled
surface_4 = Surface(unroll_brep_2)  # disabled
plane_3pt = Plane3Pt(PointA=list_item_10.Item, PointB=list_item_10.Item1, PointC=list_item_10.Item2)  # disabled
xy_plane_2 = XYPlane(Origin=Point(0, 0, 0))  # disabled
panel_8 = Panel("10")  # disabled
rectangle = Rectangle(Plane=PlaneXY(0, 0, 0), XSize=sheet_x, YSize=sheet_y, Radius=0)  # -> Rectangle, Length; disabled
unit_x = UnitX(Factor=panel_8)  # disabled
orient = Orient(Geometry=unroll_brep, Source=plane_3pt, Target=xy_plane_2)  # -> Geometry, Transform; disabled
move_3 = Move(Geometry=rectangle.Rectangle, Motion=unit_x)  # -> Geometry, Transform; disabled
merge_6 = Merge(Data1=orient.Geometry, Data2=surface_4)  # disabled
curve_3 = Curve(move_3.Geometry)  # disabled
curve_4 = Curve(merge_6)  # disabled
spacing_2 = Number(spacing)  # disabled
opennest = OpenNest(
    Sheets=curve_3,
    Geo=simplify(flatten(curve_4)),
    Spacing=spacing_2,
    Placement=1,
    Tolerance=0.1,
    Rotations=4,
    Iterations=1,
    Seed=1,
    Reset=True,
    Run=False)  # -> Sheets, Geo, ID, Transform, IDS; disabled
area_5 = Area(Geometry=opennest.Geo)  # -> Area, Centroid; disabled
panel_9 = Panel("0.2")  # disabled
text = Text(Location=area_5.Centroid, Text=opennest.ID, Size=panel_9)  # disabled
_70_100_crv_2 = Curve(opennest.Sheets)  # disabled
laser_2 = Curve(opennest.Geo)  # disabled
id_2 = Curve(text)  # disabled

# ==== cluster Cluster
input_surface = ClusterInput()
wall_edge_offset = ClusterInput()
u_beam_height = ClusterInput()
u_beam_width = ClusterInput()
u_beam_count = ClusterInput()
ceiling_height = ClusterInput()
wall_thickness = ClusterInput()
u_beam_length_reduction = ClusterInput()
v_beam_length_reduction = ClusterInput()
v_beam_height = ClusterInput()
v_beam_width = ClusterInput()
wall_height = ClusterInput()
uv_beam_overlap = ClusterInput()
v_beam_count = ClusterInput()
input_surface_2 = Surface(graft(input_surface))
u_beam_height_2 = Number(u_beam_height)
u_beam_width_2 = Number(u_beam_width)
u_beam_count_2 = Number(u_beam_count)
u_beam_length_reduction_2 = Number(u_beam_length_reduction)
v_beam_length_reduction_2 = Number(v_beam_length_reduction)
v_beam_height_2 = Number(v_beam_height)
v_beam_width_2 = Number(v_beam_width)
uv_beam_overlap_2 = Number(uv_beam_overlap)
v_beam_count_2 = Number(v_beam_count)
surface = Surface(input_surface_2)
dimensions = Dimensions(Surface=input_surface_2)  # -> UDimension, VDimension
u_count = Number(u_beam_count_2)
v_count = Number(v_beam_count_2)
addition = Addition(A=u_count, B=1)
addition_2 = Addition(A=v_count, B=1)
divide_domain² = DivideDomain²(Domain=surface, UCount=u_count, VCount="1")
divide_domain²_2 = DivideDomain²(Domain=surface, UCount="1", VCount=v_count)
isotrim = Isotrim(Surface=surface, Domain=divide_domain²)
isotrim_2 = Isotrim(Surface=surface, Domain=divide_domain²_2)
explode = Explode(Curve=isotrim, Recursive=True)  # -> Segments, Vertices
explode_2 = Explode(Curve=isotrim_2, Recursive=True)  # -> Segments, Vertices
length = Length(Curve=explode.Segments)
length_2 = Length(Curve=explode_2.Segments)
sort_list = SortList(Keys=length, ValuesValuesA=explode.Segments)  # -> Keys, reverse(ValuesValuesA)
sort_list_2 = SortList(Keys=length_2, ValuesValuesA=explode_2.Segments)  # -> Keys, reverse(ValuesValuesA)
list_item = ListItem(List=sort_list.ValuesValuesA, Index=0, Wrap=True)  # -> Item, Item1
list_item_2 = ListItem(List=sort_list_2.ValuesValuesA, Index=0, Wrap=True)  # -> Item, Item1
curve = Curve(flatten([list_item.Item1, list_item.Item]))
curve_2 = Curve(flatten([list_item_2.Item1, list_item_2.Item]))
curve_middle = CurveMiddle(Curve=curve)
curve_middle_2 = CurveMiddle(Curve=curve_2)
cull_duplicates = CullDuplicates(Points=curve_middle, Tolerance=0.1, CullMode=3)  # -> Points, Indices, Valence
cull_duplicates_2 = CullDuplicates(Points=curve_middle_2, Tolerance=0.1, CullMode=3)  # -> Points, Indices, Valence
closest_point = ClosestPoint(Point=cull_duplicates.Points, Cloud=curve_middle)  # -> ClosestPoint, CPIndex, Distance
closest_point_2 = ClosestPoint(Point=cull_duplicates_2.Points, Cloud=curve_middle_2)  # -> ClosestPoint, CPIndex, Distance
list_item_3 = ListItem(List=curve, Index=closest_point.CPIndex, Wrap=True)
list_item_4 = ListItem(List=curve_2, Index=closest_point_2.CPIndex, Wrap=True)
partition_list = PartitionList(List=list_item_3, Size=addition)
partition_list_2 = PartitionList(List=list_item_4, Size=addition_2)
u_beam_length_reduction_3 = Number(v_beam_length_reduction_2)
ipsos_y = Number(v_beam_height_2)
ipsos_x = Number(u_beam_height_2)
negative = Negative(Value=u_beam_length_reduction_3)
u_beam_length_reduction_4 = Number(u_beam_length_reduction_2)
negative_2 = Negative(Value=u_beam_length_reduction_4)
extend_curve = ExtendCurve(Curve=partition_list, Type="2", Start=negative_2, End=negative_2)
negative_3 = Negative(Value=ipsos_x)
negative_4 = Negative(Value=ipsos_y)
extend_curve_2 = ExtendCurve(Curve=partition_list_2, Type="2", Start=negative, End=negative)
unit_z = UnitZ(Factor=negative_3)
unit_z_2 = UnitZ(Factor=negative_4)
extrude = Extrude(Base=extend_curve, Direction=unit_z)
extrude_2 = Extrude(Base=extend_curve_2, Direction=unit_z_2)
platos_x = Number(u_beam_width_2)
platos_y = Number(v_beam_width_2)
division = Division(A=platos_x, B=2)
division_2 = Division(A=platos_y, B=2)
negative_5 = Negative(Value=division)
negative_6 = Negative(Value=division_2)
offset_surface = OffsetSurface(Surface=extrude, Distance=division, BothSides=negative_5, CreateSolid=True)  # -> simplify(Offset)
offset_surface_2 = OffsetSurface(Surface=extrude_2, Distance=division_2, BothSides=negative_6, CreateSolid=True)  # -> simplify(Offset)
unflatten_tree = UnflattenTree(Tree=flatten(offset_surface), Guide=extrude)
unflatten_tree_2 = UnflattenTree(Tree=flatten(offset_surface_2), Guide=extrude_2)
poso_akoumpane_ta_ksila = Number(uv_beam_overlap_2)
area = Area(Geometry=unflatten_tree_2)  # -> Area, Centroid
negative_7 = Negative(Value=poso_akoumpane_ta_ksila)
area_2 = Area(Geometry=unflatten_tree)  # -> Area, Centroid
unit_z_3 = UnitZ(Factor=negative_7)
panel = Panel("""-1
0""")
panel_2 = Panel("""-1
0""")
entwine = Entwine(
    Branch00=ColourSwatch(SwatchColor=RGB(194, 184, 163)),
    Branch01=ColourSwatch(SwatchColor=RGB(255, 105, 105)),
    Branch02=ColourSwatch(SwatchColor=RGB(135, 140, 93)),
    Branch03=ColourSwatch(SwatchColor=RGBA(98, 66, 173, 78)),
    FlattenInputs=True)
result = ClusterOutput(entwine)

wall_edge_offset_2 = Number(wall_edge_offset)
ceiling_height_2 = Number(ceiling_height)
wall_thickness_2 = Number(wall_thickness)
wall_height_2 = Number(wall_height)
ypsos_orofis = Number(ceiling_height_2)
unit_z_4 = UnitZ(Factor=ypsos_orofis)
surface_points = SurfacePoints(Surface=surface)  # -> Points, Weights, Greville, UCount, VCount
extrude_3 = Extrude(Base=surface, Direction=unit_z_4)
perigrama_crv = Curve(surface)
offset = Number(wall_edge_offset_2)
platos_tixos = Number(wall_thickness_2)
offset_on_srf = OffsetOnSrf(Curve=perigrama_crv, Distance=offset, Surface=surface)
deconstruct_brep = DeconstructBrep(Brep=surface)  # -> Faces, Edges, Vertices
offset_on_srf_2 = OffsetOnSrf(Curve=offset_on_srf, Distance=platos_tixos, Surface=surface)
deconstruct = Deconstruct(Point=deconstruct_brep.Vertices)  # -> XComponent, YComponent, ZComponent
merge = Merge(Data1=simplify(offset_on_srf_2), Data2=simplify(offset_on_srf))
sort_list_3 = SortList(Keys=deconstruct.ZComponent, ValuesValuesA=deconstruct_brep.Vertices)  # -> Keys, ValuesValuesA
list_item_5 = ListItem(List=sort_list_3.ValuesValuesA, Index=0, Wrap=True)
xy_plane = XYPlane(Origin=list_item_5)
project = Project(Geometry=merge, Plane=xy_plane)  # -> Geometry, Transform
ypsos_tixos = Number(wall_height_2)
negative_8 = Negative(Value=ypsos_tixos)
unit_z_5 = UnitZ(Factor=negative_8)
move = Move(Geometry=project.Geometry, Motion=unit_z_5)  # -> Geometry, Transform
merge_2 = Merge(Data1=simplify(move.Geometry), Data2=reverse(simplify(merge)))
loft_options = LoftOptions(Closed=Toggle(True), Adjust=False, Rebuild=0, Refit=0, Type="3")
loft = Loft(Curves=merge_2, Options=loft_options)
list_item_6 = ListItem(List=list_item_5, Index=0, Wrap=True)

distance = Distance(PointA=list_item_6, PointB=area.Centroid)
distance_2 = Distance(PointA=list_item_6, PointB=area_2.Centroid)
data = Data(list_item_6)
sort_list_4 = SortList(Keys=distance, ValuesValuesA=unflatten_tree_2)  # -> Keys, ValuesValuesA
sort_list_5 = SortList(Keys=distance_2, ValuesValuesA=unflatten_tree)  # -> Keys, ValuesValuesA
move_2 = Move(Geometry=sort_list_5.ValuesValuesA, Motion=unit_z_3)  # -> Geometry, Transform
cull_index = CullIndex(List=sort_list_4.ValuesValuesA, Indices=panel, Wrap=True)
cull_index_2 = CullIndex(List=move_2.Geometry, Indices=panel_2, Wrap=True)  # -> graft(List)
solid_difference = SolidDifference(BrepsA=cull_index_2, BrepsB=flatten(cull_index))
trim_tree = TrimTree(Tree=solid_difference, Depth=1)

merge_3 = Merge(Data1=trim_tree, Data2=cull_index)
solid_difference_2 = SolidDifference(BrepsA=simplify(loft), BrepsB=simplify(merge_3))

entwine_2 = Entwine(Branch00=trim_tree, Branch01=cull_index, Branch02=extrude_3, Branch03=solid_difference_2, FlattenInputs=True)
result_2 = ClusterOutput(entwine_2)

# ==== cluster Cluster_2
data = ClusterInput()
sheet_x = ClusterInput()
sheet_y = ClusterInput()
explode_tree = ExplodeTree(Data=data)  # -> Branch0, Branch1, Branch2
spacing = ClusterInput()
sheet_x_2 = Number(sheet_x)
sheet_y_2 = Number(sheet_y)
spacing_2 = Number(spacing)
merge = Merge(Data1=explode_tree.Branch0, Data2=explode_tree.Branch1)
brep = Brep(flatten(merge))
brep_2 = Brep(flatten(explode_tree.Branch2))
deconstruct_brep = DeconstructBrep(Brep=brep)  # -> Faces, Edges, Vertices
deconstruct_brep_2 = DeconstructBrep(Brep=brep_2)  # -> Faces, Edges, Vertices
area = Area(Geometry=deconstruct_brep.Faces)  # -> Area, Centroid
area_2 = Area(Geometry=deconstruct_brep_2.Faces)  # -> Area, Centroid
sort_list = SortList(Keys=area.Area, ValuesValuesA=deconstruct_brep.Faces)  # -> Keys, reverse(ValuesValuesA)
sort_list_2 = SortList(Keys=area_2.Area, ValuesValuesA=deconstruct_brep_2.Faces)  # -> Keys, reverse(ValuesValuesA)
list_item = ListItem(List=sort_list.ValuesValuesA, Index=0, Wrap=True)
unroll_brep = UnrollBrep(Brep=list_item, JoinUnrolled=False)
list_item_2 = ListItem(List=sort_list_2.ValuesValuesA, Index=0, Wrap=True)
unroll_brep_2 = UnrollBrep(Brep=list_item_2, JoinUnrolled=False)
populate_geometry = PopulateGeometry(Geometry=unroll_brep, Count="3", Seed=1)
list_item_3 = ListItem(List=populate_geometry, Index=0, Wrap=True)  # -> Item, Item1, Item2
surface = Surface(unroll_brep_2)
plane_3pt = Plane3Pt(PointA=list_item_3.Item, PointB=list_item_3.Item1, PointC=list_item_3.Item2)
xy_plane = XYPlane(Origin=Point(0, 0, 0))
rectangle = Rectangle(Plane=PlaneXY(0, 0, 0), XSize=sheet_x_2, YSize=sheet_y_2, Radius=0)  # -> Rectangle, Length
unit_x = UnitX(Factor="10")
orient = Orient(Geometry=unroll_brep, Source=plane_3pt, Target=xy_plane)  # -> Geometry, Transform
move = Move(Geometry=rectangle.Rectangle, Motion=unit_x)  # -> Geometry, Transform
merge_2 = Merge(Data1=orient.Geometry, Data2=surface)
curve = Curve(move.Geometry)
curve_2 = Curve(merge_2)
spacing_3 = Number(spacing_2)
opennest = OpenNest(
    Sheets=curve,
    Geo=simplify(flatten(curve_2)),
    Spacing=spacing_3,
    Placement=1,
    Tolerance=0.1,
    Rotations=4,
    Iterations=1,
    Seed=1,
    Reset=True,
    Run=False)  # -> Sheets, Geo, ID, Transform, IDS
area_3 = Area(Geometry=opennest.Geo)  # -> Area, Centroid
text = Text(Location=area_3.Centroid, Text=opennest.ID, Size="0.2")
_70_100_crv = Curve(opennest.Sheets)
laser = Curve(opennest.Geo)
id = Curve(text)
laser_2 = ClusterOutput(laser)
id_2 = ClusterOutput(id)
_70_100_crv_2 = ClusterOutput(_70_100_crv)
