# Grasshopper definition grass_window.gh (Grasshopper 1.0.8)
# plug-ins: Pufferfish

number_slider = Slider(0.07, range=0.03..0.15)  # disabled
number_slider_2 = Slider(0.02, range=0.02..0.06)  # disabled
number_slider_3 = Slider(0.03, range=0.01..0.07)  # disabled
number_slider_4 = Slider(2.2, range=1..3)  # disabled
number_slider_5 = Slider(0.1, range=0.05..0.15)  # disabled
number_slider_6 = Slider(0.3, range=0.1..0.5)  # disabled
number_slider_7 = Slider(4, range=1..5)  # disabled
number_slider_8 = Slider(0.07, range=0.03..0.15)  # disabled
number_slider_9 = Slider(0.06, range=0.05..0.1)  # disabled
number_slider_10 = Slider(0.2, range=0.03..0.2)  # disabled
value_list = ValueList({"xoris_ipostilomata": 0, "me_ipostilomata": 1, "anigoklinomeno": 2}, selected="anigoklinomeno")  # disabled

number_slider_11 = Slider(2.2, range=1..3)  # disabled
number_slider_12 = Slider(0.1, range=0.05..0.15)  # disabled
number_slider_13 = Slider(0.2, range=0.1..1.1)  # disabled
value_list_2 = ValueList({"porta": 3, "parathiro": 4}, selected="porta")  # disabled

number_slider_14 = Slider(0.07, range=0.03..0.15)  # disabled
number_slider_15 = Slider(0.1, range=0.03..0.15)  # disabled

number_slider_16 = Slider(0.02, range=0.02..0.06)  # disabled
number_slider_17 = Slider(0.03, range=0.01..0.07)  # disabled

# ----
# version_1
# 20.05.2026
number_slider_18 = Slider(2, range=1..5)  # disabled
curve = Curve([<curve referenced from the Rhino model> x3])  # disabled
curve_2 = Curve(<curve referenced from the Rhino model>)  # disabled
cluster = Cluster_2(
    input_crv=curve,
    switch=value_list_2,
    ypsos=number_slider_11,
    frame_diametros=number_slider_12,
    frame_platos=number_slider_13,
    arithmos_anigmata=number_slider_18,
    parathiro_diametros=number_slider_14,
    parathiro_platos=number_slider_15,
    giali_platos=number_slider_16,
    giali_frame=number_slider_17)  # -> result, result_2; disabled
custom_preview = CustomPreview(Geometry=cluster.result, Material=cluster.result_2)  # disabled

curve_3 = Curve([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])  # disabled
value_list_3 = ValueList({"porta": 3, "parathiro": 4}, selected="parathiro")  # disabled
ipostiloma_diametros = Number(number_slider_9)  # disabled
switch_porta_parathira = Data(value_list_3)  # disabled
switch_ipostilomata = Data(value_list)  # disabled
parathiro_diametros = Number(number_slider)  # disabled
arithmos_anigmata = Number(number_slider_7)  # disabled
ipostiloma_platos = Number(number_slider_10)  # disabled
input_crv = Curve(graft(curve_3))  # disabled
frame_diametros = Number(number_slider_5)  # disabled
parathiro_platos = Number(number_slider_8)  # disabled
frame_platos = Number(number_slider_6)  # disabled
giali_platos = Number(number_slider_2)  # disabled
giali_frame = Number(number_slider_3)  # disabled
ypsos = Number(number_slider_4)  # disabled
ypsos_2 = Number(ypsos)  # disabled
end_points = EndPoints(Curve=input_crv)  # -> Start, End; disabled
unit_z = UnitZ(Factor=ypsos_2)  # disabled
negative = Negative(Value=frame_diametros)  # disabled
move = Move(Geometry=end_points.End, Motion=unit_z)  # -> Geometry, Transform; disabled

# ----
# version_2
# 25.05.2026
number_slider_19 = Slider(2.2, range=1..3)  # disabled
number_slider_20 = Slider(0.1, range=0.05..0.15)  # disabled
number_slider_21 = Slider(0.3, range=0.1..0.5)  # disabled
number_slider_22 = Slider(3, range=1..5)  # disabled
number_slider_23 = Slider(0.07, range=0.03..0.15)  # disabled
number_slider_24 = Slider(0.07, range=0.03..0.15)  # disabled
number_slider_25 = Slider(0.02, range=0.02..0.06)  # disabled
number_slider_26 = Slider(0.03, range=0.01..0.07)  # disabled
number_slider_27 = Slider(0.06, range=0.05..0.1)  # disabled
number_slider_28 = Slider(0.2, range=0.03..0.2)  # disabled
value_list_4 = ValueList({"xoris_ipostilomata": 0, "me_ipostilomata": 1}, selected="me_ipostilomata")  # disabled
value_list_5 = ValueList({"porta": 3, "parathiro": 4}, selected="parathiro")  # disabled
curve_4 = Curve([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])  # disabled
get_line = GetLine(curve_4, AtLeast=1, AtMost=1, Realtime=True, TreeAccess=False)  # disabled
switch_porta_parathira_3_4 = GetNumber(value_list_5, AtLeast=1, AtMost=1, Maximum=4, Minimum=3, TreeAccess=False)  # disabled
switch_ipostilomata_1_on = GetNumber(value_list_4, AtLeast=1, AtMost=1, Maximum=1.797693135e+308, Minimum=-1.797693135e+308, TreeAccess=False)  # disabled
ypsos_2_2 = GetNumber(number_slider_19, AtLeast=1, AtMost=1, Maximum=1.797693135e+308, Minimum=-1.797693135e+308, TreeAccess=False)  # disabled
frame_diametros_0_10 = GetNumber(number_slider_20, AtLeast=1, AtMost=1, Maximum=1.797693135e+308, Minimum=-1.797693135e+308, TreeAccess=False)  # disabled
frame_platos_0_30 = GetNumber(number_slider_21, AtLeast=1, AtMost=1, Maximum=1.797693135e+308, Minimum=-1.797693135e+308, TreeAccess=False)  # disabled
arithmos_amigmaton_3 = GetNumber(number_slider_22, AtLeast=1, AtMost=1, Maximum=1.797693135e+308, Minimum=-1.797693135e+308, TreeAccess=False)  # disabled
parathiro_diametros_0_07 = GetNumber(number_slider_23, AtLeast=1, AtMost=1, Maximum=1.797693135e+308, Minimum=-1.797693135e+308, TreeAccess=False)  # disabled
parathiro_platos_0_07 = GetNumber(number_slider_24, AtLeast=1, AtMost=1, Maximum=1.797693135e+308, Minimum=-1.797693135e+308, TreeAccess=False)  # disabled
giali_platos_0_03 = GetNumber(number_slider_25, AtLeast=1, AtMost=1, Maximum=1.797693135e+308, Minimum=-1.797693135e+308, TreeAccess=False)  # disabled
giali_frame_0_03 = GetNumber(number_slider_26, AtLeast=1, AtMost=1, Maximum=1.797693135e+308, Minimum=-1.797693135e+308, TreeAccess=False)  # disabled
ipostiloma_diametros_0_06 = GetNumber(number_slider_27, AtLeast=1, AtMost=1, Maximum=1.797693135e+308, Minimum=-1.797693135e+308, TreeAccess=False)  # disabled
ipostiloma_platos_0_20 = GetNumber(number_slider_28, AtLeast=1, AtMost=1, Maximum=1.797693135e+308, Minimum=-1.797693135e+308, TreeAccess=False)  # disabled
cluster_2 = Cluster_5(
    input_crv=get_line,
    switch_porta_parathira=switch_porta_parathira_3_4,
    switch_ipostilomata=switch_ipostilomata_1_on,
    ypsos=ypsos_2_2,
    frame_diametros=frame_diametros_0_10,
    frame_platos=frame_platos_0_30,
    arithmos_anigmata=arithmos_amigmaton_3,
    parathiro_diametros=parathiro_diametros_0_07,
    parathiro_platos=parathiro_platos_0_07,
    giali_platos=giali_platos_0_03,
    giali_frame=giali_frame_0_03,
    ipostiloma_diametros=ipostiloma_diametros_0_06,
    ipostiloma_platos=ipostiloma_platos_0_20)  # -> result, result_2; disabled
custom_preview_2 = CustomPreview(Geometry=cluster_2.result, Material=cluster_2.result_2)  # disabled

rectangle_3pt = Rectangle3Pt(PointA=end_points.Start, PointB=end_points.End, PointC=move.Geometry)  # -> Rectangle, Length; disabled
plane_3pt = Plane3Pt(PointA=end_points.Start, PointB=end_points.End, PointC=move.Geometry)  # disabled
brep_edges = BrepEdges(Brep=rectangle_3pt.Rectangle)  # -> Naked, Interior, NonManifold; disabled
curve_middle = CurveMiddle(Curve=brep_edges.Naked)  # disabled
deconstruct = Deconstruct(Point=curve_middle)  # -> XComponent, YComponent, ZComponent; disabled
switch = Data(switch_porta_parathira)  # disabled
sort_list = SortList(Keys=deconstruct.ZComponent, ValuesValuesA=brep_edges.Naked)  # -> Keys, reverse(ValuesValuesA); disabled

# ----
# version_3
# 25.05.2026
curve_5 = Curve([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])  # disabled
number_slider_29 = Slider(2.2, range=1..3)  # disabled
number_slider_30 = Slider(0.1, range=0.05..0.15)  # disabled
number_slider_31 = Slider(0.3, range=0.1..0.5)  # disabled
number_slider_32 = Slider(4, range=1..5)  # disabled
number_slider_33 = Slider(0.07, range=0.03..0.15)  # disabled
number_slider_34 = Slider(0.07, range=0.03..0.15)  # disabled
number_slider_35 = Slider(0.02, range=0.02..0.06)  # disabled
number_slider_36 = Slider(0.03, range=0.01..0.07)  # disabled
number_slider_37 = Slider(0.06, range=0.05..0.1)  # disabled
number_slider_38 = Slider(0.2, range=0.03..0.2)  # disabled
value_list_6 = ValueList({"xoris_ipostilomata": 0, "me_ipostilomata": 1, "anigoklinomeno": 2}, selected="me_ipostilomata")  # disabled
value_list_7 = ValueList({"porta": 3, "parathiro": 4}, selected="porta")  # disabled
cluster_3 = Cluster_7(
    input_crv=curve_5,
    switch_porta_parathira=value_list_7,
    switch_ipostilomata=value_list_6,
    ypsos=number_slider_29,
    frame_diametros=number_slider_30,
    frame_platos=number_slider_31,
    arithmos_anigmata=number_slider_32,
    parathiro_diametros=number_slider_33,
    parathiro_platos=number_slider_34,
    giali_platos=number_slider_35,
    giali_frame=number_slider_36,
    ipostiloma_diametros=number_slider_37,
    ipostiloma_platos=number_slider_38)  # -> result, result_2; disabled
custom_preview_3 = CustomPreview(Geometry=cluster_3.result, Material=cluster_3.result_2)  # disabled

split_list = SplitList(List=sort_list.ValuesValuesA, Index=switch)  # -> ListA, ListB; disabled
join_curves = JoinCurves(Curves=split_list.ListA, Preserve=False)  # disabled
frame_platos_2 = Number(frame_platos)  # disabled
frame_diametros_2 = Number(negative)  # disabled
offset_curve = OffsetCurve(Curve=join_curves, Distance=frame_diametros_2, Plane=plane_3pt, Corners=1)  # disabled
merge = Merge(Data1=simplify(graft(join_curves)), Data2=simplify(graft(offset_curve)))  # disabled
cluster_4 = Cluster(curve=offset_curve)  # disabled
amplitude = Amplitude(Vector=plane_3pt, Amplitude=frame_platos_2)  # disabled
loft = Loft(Curves=merge, Options={Adjust=False, Closed=False, LoftEnds=0, LoftSimp=0, LoftType=0, Rebuild=10, Refit=0.01})  # disabled
akriana_crvs = Data(cluster_4)  # disabled
division = Division(A=amplitude, B=2)  # disabled
value_list_8 = ValueList({"no_flip": 0, "flip_curve": 1}, selected="no_flip")
extrude = Extrude(Base=loft, Direction=amplitude)  # disabled
move_2 = Move(Geometry=akriana_crvs, Motion=division)  # -> Geometry, Transform; disabled
ipostiloma_diametros_2 = Number(ipostiloma_diametros)  # disabled
flip_crv_1_on = GetNumber(
    value_list_8,
    AtLeast=1,
    AtMost=1,
    Maximum=1.797693135e+308,
    Minimum=-1.797693135e+308,
    Prompt="no_flip=0,flip_curve=1",
    TreeAccess=False)

# ----
# version_4_grass_pl
# 
# 01.06.2026
number_slider_39 = Slider(2.2, range=1..3)
curve_6 = Curve([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])
value_list_9 = ValueList({"porta": 3, "parathiro": 4}, selected="porta")
value_list_10 = ValueList({"fixed": 0, "with_columns": 1, "Sliding": 2}, selected="Sliding")
none_0_columns_1_window_2 = GetNumber(value_list_10, AtLeast=1, AtMost=1, Maximum=2, Minimum=-1.797693135e+308, TreeAccess=False)
door_3_window_4 = GetNumber(value_list_9, AtLeast=1, AtMost=1, Maximum=4, Minimum=3, TreeAccess=False)
get_geometry = GetGeometry(curve_6, AnnotationTypeFilter=3966, AtLeast=1, AtMost=10, DeleteInput=False, Filter=1074081852, TreeAccess=False)
height_2_2 = GetNumber(number_slider_39, AtLeast=1, AtMost=1, Maximum=1.797693135e+308, Minimum=-1.797693135e+308, TreeAccess=False)
frame_diameter_0_10 = GetNumber(
    Slider(0.1, range=0.05..0.15),
    AtLeast=1,
    AtMost=1,
    Maximum=1.797693135e+308,
    Minimum=-1.797693135e+308,
    TreeAccess=False)
frame_width_0_30 = GetNumber(Slider(0.3, range=0.1..0.5), AtLeast=1, AtMost=1, Maximum=1.797693135e+308, Minimum=-1.797693135e+308, TreeAccess=False)
number_of_openings_3 = GetNumber(Slider(3, range=1..5), AtLeast=1, AtMost=1, Maximum=1.797693135e+308, Minimum=-1.797693135e+308, TreeAccess=False)
window_diameter_0_07 = GetNumber(
    Slider(0.07, range=0.03..0.15),
    AtLeast=1,
    AtMost=1,
    Maximum=1.797693135e+308,
    Minimum=-1.797693135e+308,
    TreeAccess=False)
window_diameter_0_07_2 = GetNumber(
    Slider(0.07, range=0.03..0.15),
    AtLeast=1,
    AtMost=1,
    Maximum=1.797693135e+308,
    Minimum=-1.797693135e+308,
    TreeAccess=False)
glass_width_0_03 = GetNumber(
    Slider(0.02, range=0.02..0.06),
    AtLeast=1,
    AtMost=1,
    Maximum=1.797693135e+308,
    Minimum=-1.797693135e+308,
    TreeAccess=False)
glass_frame_0_03 = GetNumber(
    Slider(0.03, range=0.01..0.07),
    AtLeast=1,
    AtMost=1,
    Maximum=1.797693135e+308,
    Minimum=-1.797693135e+308,
    TreeAccess=False)
column_diameter_0_06 = GetNumber(
    Slider(0.06, range=0.05..0.1),
    {"0.2"}, selected=[],
    AtLeast=1,
    AtMost=1,
    Maximum=1.797693135e+308,
    Minimum=-1.797693135e+308,
    TreeAccess=False)
column_width_0_20 = GetNumber(Slider(0.2, range=0.03..0.2), AtLeast=1, AtMost=1, Maximum=1.797693135e+308, Minimum=-1.797693135e+308, TreeAccess=False)
cluster_5 = Cluster_7(
    input_crv=get_geometry,
    flip_curve=flip_crv_1_on,
    switch_porta_parathira=door_3_window_4,
    switch_ipostilomata=none_0_columns_1_window_2,
    ypsos=height_2_2,
    frame_diametros=frame_diameter_0_10,
    frame_platos=frame_width_0_30,
    arithmos_anigmata=number_of_openings_3,
    parathiro_diametros=window_diameter_0_07,
    parathiro_platos=window_diameter_0_07_2,
    giali_platos=glass_width_0_03,
    giali_frame=glass_frame_0_03,
    ipostiloma_diametros=column_diameter_0_06,
    ipostiloma_platos=column_width_0_20)  # -> result, result_2
context_bake = ContextBake(Content=flatten(cluster_5.result))
custom_preview_4 = CustomPreview(Geometry=cluster_5.result, Material=cluster_5.result_2)

parathiro_diametros_2 = Number(parathiro_diametros)  # disabled
switch_ipostilomata_2 = Data(switch_ipostilomata)  # disabled
arithmos_anigmata_2 = Number(arithmos_anigmata)  # disabled
frame = Brep(extrude)  # disabled
vector = Vector(plane_3pt)  # disabled
cluster_6 = Me_ipostilomata(geometry=move_2.Geometry, count=arithmos_anigmata_2, platos_ipostilomaton=ipostiloma_diametros_2)  # -> list_a, list_b; disabled
cluster_7 = Cluster_3(
    geometry=move_2.Geometry,
    count=arithmos_anigmata_2,
    platos_ipostilomaton=parathiro_diametros_2,
    parathira_platos=parathiro_platos,
    vector=vector)  # disabled
cluster_8 = Cluster_4(curves=move_2.Geometry, arithmos_anigmata=arithmos_anigmata_2)  # disabled
error = Panel("55")  # disabled
weave = Weave(Pattern=switch_ipostilomata_2, Stream0=error, Stream1=cluster_6.list_b, NullGaps=False)  # disabled
weave_2 = Weave(Pattern=switch_ipostilomata_2, Stream0=cluster_8, Stream1=cluster_6.list_a, Stream2=cluster_7, NullGaps=False)  # disabled
negative_2 = Negative(Value=parathiro_diametros_2)  # disabled
ipostilomata_srf = Data(weave)  # disabled
offset_curve_2 = OffsetCurve(Curve=simplify(weave_2), Distance=negative_2, Corners=1)  # -> flatten(Curve); disabled
curve_7 = Curve(simplify(flatten(weave_2)))  # disabled
giali_frame_2 = Number(giali_frame)  # disabled
merge_2 = Merge(Data1=graft(curve_7), Data2=graft(offset_curve_2))  # disabled
negative_3 = Negative(Value=giali_frame_2)  # disabled
offset_curve_3 = OffsetCurve(Curve=simplify(offset_curve_2), Distance=negative_3, Corners=1)  # -> flatten(Curve); disabled
loft_2 = Loft(Curves=merge_2, Options={Adjust=False, Closed=False, LoftEnds=0, LoftSimp=0, LoftType=0, Rebuild=10, Refit=0.01})  # disabled
giali_platos_2 = Number(giali_platos)  # disabled
merge_3 = Merge(Data1=graft(offset_curve_2), Data2=graft(offset_curve_3))  # disabled
parathiro_platos_2 = Number(parathiro_platos)  # disabled
loft_3 = Loft(Curves=merge_3, Options={Adjust=False, Closed=False, LoftEnds=0, LoftSimp=0, LoftType=0, Rebuild=10, Refit=0.01})  # disabled
addition = Addition(A=giali_platos_2, B=0.02)  # disabled
ipostiloma_platos_2 = Number(ipostiloma_platos)  # disabled
expression = Expression(x=parathiro_platos_2, Expression="x/2")  # disabled
expression_2 = Expression(x=giali_platos_2, Expression="x/2")  # disabled
expression_3 = Expression(x=ipostiloma_platos_2, Expression="x/2")  # disabled
expression_4 = Expression(x=addition, Expression="x/2")  # disabled
negative_4 = Negative(Value=expression_2)  # disabled
negative_5 = Negative(Value=expression_3)  # disabled
negative_6 = Negative(Value=expression)  # disabled
negative_7 = Negative(Value=expression_4)  # disabled
offset_surface = OffsetSurface(Surface=loft_2, Distance=expression, BothSides=negative_6, CreateSolid=True)  # disabled
offset_surface_2 = OffsetSurface(Surface=loft_3, Distance=expression_4, BothSides=negative_7, CreateSolid=True)  # disabled
offset_surface_3 = OffsetSurface(Surface=offset_curve_3, Distance=expression_2, BothSides=negative_4, CreateSolid=True)  # disabled
offset_surface_4 = OffsetSurface(Surface=ipostilomata_srf, Distance=expression_3, BothSides=negative_5, CreateSolid=True)  # disabled
solid_union = SolidUnion(Breps=offset_surface)  # disabled
solid_union_2 = SolidUnion(Breps=offset_surface_2)  # disabled
ipostiloma_platos_3 = Brep(offset_surface_4)  # disabled
giali_frame_3 = Brep(solid_union_2)  # disabled
parathira = Brep(solid_union)  # disabled
frame_2 = Brep(frame)  # disabled
giali = Brep(offset_surface_3)  # disabled

# ---- group: fotino_frame
deconstruct_material = DeconstructMaterial(Material={diffuse=RGB(0, 0, 0), emission=RGB(0, 0, 0), shine=1, specular=RGB(250, 250, 250), transparency=0})  # -> Diffuse, Specular, Emission, Transparency, Shine; disabled
create_material = CreateMaterial(
    Diffuse=deconstruct_material.Diffuse,
    Specular=deconstruct_material.Specular,
    Emission=deconstruct_material.Emission,
    Transparency=deconstruct_material.Transparency,
    Shine=deconstruct_material.Shine)  # disabled

# ---- group: skouro_eksoteriko
deconstruct_material_2 = DeconstructMaterial(Material={diffuse=RGB(0, 0, 0), emission=RGB(0, 0, 0), shine=0.41, specular=RGB(104, 104, 104), transparency=0})  # -> Diffuse, Specular, Emission, Transparency, Shine; disabled
create_material_2 = CreateMaterial(
    Diffuse=deconstruct_material_2.Diffuse,
    Specular=deconstruct_material_2.Specular,
    Emission=deconstruct_material_2.Emission,
    Transparency=deconstruct_material_2.Transparency,
    Shine=deconstruct_material_2.Shine)  # disabled

# ---- group: yiali
deconstruct_material_3 = DeconstructMaterial(Material={diffuse=RGB(0, 0, 0), emission=RGB(0, 0, 0), shine=1, specular=RGB(255, 255, 255), transparency=1})  # -> Diffuse, Specular, Emission, Transparency, Shine; disabled
create_material_3 = CreateMaterial(
    Diffuse=deconstruct_material_3.Diffuse,
    Specular=deconstruct_material_3.Specular,
    Emission=deconstruct_material_3.Emission,
    Transparency=deconstruct_material_3.Transparency,
    Shine=deconstruct_material_3.Shine)  # disabled

# ----
entwine = Entwine(
    Branch00=frame_2,
    Branch01=parathira,
    Branch02=giali_frame_3,
    Branch03=giali,
    Branch04=ipostiloma_platos_3,
    FlattenInputs=True)  # disabled
entwine_2 = Entwine(
    Branch00=create_material_2,
    Branch01=create_material,
    Branch02=create_material,
    Branch03=create_material_3,
    Branch04=create_material_2,
    FlattenInputs=True)  # disabled
custom_preview_5 = CustomPreview(Geometry=entwine, Material=entwine_2)  # disabled

# ----
# version_3_grass_playtrt
# 
# 25.05.2026
number_slider_40 = Slider(3, range=1..5)  # disabled
number_slider_41 = Slider(0.06, range=0.05..0.1)  # disabled
number_slider_42 = Slider(0.2, range=0.03..0.2)  # disabled
number_slider_43 = Slider(2.2, range=1..3)  # disabled
number_slider_44 = Slider(0.1, range=0.05..0.15)  # disabled
number_slider_45 = Slider(0.3, range=0.1..0.5)  # disabled
number_slider_46 = Slider(0.07, range=0.03..0.15)  # disabled
number_slider_47 = Slider(0.07, range=0.03..0.15)  # disabled
number_slider_48 = Slider(0.02, range=0.02..0.06)  # disabled
number_slider_49 = Slider(0.03, range=0.01..0.07)  # disabled
curve_8 = Curve([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])  # disabled
value_list_11 = ValueList({"xoris_ipostilomata": 0, "me_ipostilomata": 1, "anigoklinomeno": 2}, selected="me_ipostilomata")  # disabled
value_list_12 = ValueList({"porta": 3, "parathiro": 4}, selected="parathiro")  # disabled
none_0_columns_1_window_2_2 = GetNumber(value_list_11, AtLeast=1, AtMost=1, Maximum=2, Minimum=-1.797693135e+308, TreeAccess=False)  # disabled
door_3_window_4_2 = GetNumber(value_list_12, AtLeast=1, AtMost=1, Maximum=4, Minimum=3, TreeAccess=False)  # disabled
height_2_2_2 = GetNumber(number_slider_43, AtLeast=1, AtMost=1, Maximum=1.797693135e+308, Minimum=-1.797693135e+308, TreeAccess=False)  # disabled
frame_diameter_0_10_2 = GetNumber(number_slider_44, AtLeast=1, AtMost=1, Maximum=1.797693135e+308, Minimum=-1.797693135e+308, TreeAccess=False)  # disabled
frame_width_0_30_2 = GetNumber(number_slider_45, AtLeast=1, AtMost=1, Maximum=1.797693135e+308, Minimum=-1.797693135e+308, TreeAccess=False)  # disabled
number_of_openings_3_2 = GetNumber(number_slider_40, AtLeast=1, AtMost=1, Maximum=1.797693135e+308, Minimum=-1.797693135e+308, TreeAccess=False)  # disabled
window_diameter_0_07_3 = GetNumber(number_slider_46, AtLeast=1, AtMost=1, Maximum=1.797693135e+308, Minimum=-1.797693135e+308, TreeAccess=False)  # disabled
window_diameter_0_07_4 = GetNumber(number_slider_47, AtLeast=1, AtMost=1, Maximum=1.797693135e+308, Minimum=-1.797693135e+308, TreeAccess=False)  # disabled
glass_width_0_03_2 = GetNumber(number_slider_48, AtLeast=1, AtMost=1, Maximum=1.797693135e+308, Minimum=-1.797693135e+308, TreeAccess=False)  # disabled
glass_frame_0_03_2 = GetNumber(number_slider_49, AtLeast=1, AtMost=1, Maximum=1.797693135e+308, Minimum=-1.797693135e+308, TreeAccess=False)  # disabled
column_diameter_0_06_2 = GetNumber(
    number_slider_41,
    {"0.2"}, selected=[],
    AtLeast=1,
    AtMost=1,
    Maximum=1.797693135e+308,
    Minimum=-1.797693135e+308,
    TreeAccess=False)  # disabled
column_width_0_20_2 = GetNumber(number_slider_42, AtLeast=1, AtMost=1, Maximum=1.797693135e+308, Minimum=-1.797693135e+308, TreeAccess=False)  # disabled

get_geometry_2 = GetGeometry(curve_8, AnnotationTypeFilter=3966, AtLeast=1, AtMost=10, DeleteInput=False, Filter=1074081852, TreeAccess=False)  # disabled

cluster_9 = Cluster_7(
    input_crv=get_geometry_2,
    switch_porta_parathira=door_3_window_4_2,
    switch_ipostilomata=none_0_columns_1_window_2_2,
    ypsos=height_2_2_2,
    frame_diametros=frame_diameter_0_10_2,
    frame_platos=frame_width_0_30_2,
    arithmos_anigmata=number_of_openings_3_2,
    parathiro_diametros=window_diameter_0_07_3,
    parathiro_platos=window_diameter_0_07_4,
    giali_platos=glass_width_0_03_2,
    giali_frame=glass_frame_0_03_2,
    ipostiloma_diametros=column_diameter_0_06_2,
    ipostiloma_platos=column_width_0_20_2)  # -> result, result_2; disabled
custom_preview_6 = CustomPreview(Geometry=cluster_9.result, Material=cluster_9.result_2)  # disabled

context_bake_2 = ContextBake(Content=flatten(cluster_9.result))  # disabled

# ==== cluster Cluster
curve = ClusterInput()
explode = Explode(Curve=curve, Recursive=True)  # -> Segments, Vertices
curve_middle = CurveMiddle(Curve=explode.Segments)
deconstruct = Deconstruct(Point=curve_middle)  # -> XComponent, YComponent, ZComponent
sort_list = SortList(Keys=deconstruct.ZComponent, ValuesValuesA=explode.Segments)  # -> Keys, reverse(ValuesValuesA)
list_item = ListItem(List=simplify(sort_list.ValuesValuesA), Index=0, Wrap=True)  # -> Item, Item1, Item2
flip_curve = FlipCurve(Curve=list_item.Item2)  # -> Curve, Flag
merge = Merge(Data1=list_item.Item1, Data2=flip_curve.Curve)
akriana_crvs = Data(merge)
akriana_crvs_2 = ClusterOutput(akriana_crvs)

# ==== cluster Cluster_2
parathiro_diametros = ClusterInput()
arithmos_anigmata = ClusterInput()
input_crv = ClusterInput()
frame_diametros = ClusterInput()
parathiro_platos = ClusterInput()
frame_platos = ClusterInput()
giali_platos = ClusterInput()
giali_frame = ClusterInput()
switch = ClusterInput()
ypsos = ClusterInput()
parathiro_diametros_2 = Number(parathiro_diametros)
arithmos_anigmata_2 = Number(arithmos_anigmata)
input_crv_2 = Curve(graft(input_crv))
frame_diametros_2 = Number(frame_diametros)
parathiro_platos_2 = Number(parathiro_platos)
frame_platos_2 = Number(frame_platos)
giali_platos_2 = Number(giali_platos)
giali_frame_2 = Number(giali_frame)
switch_2 = Data(switch)
ypsos_2 = Number(ypsos)
ypsos_3 = Number(ypsos_2)
end_points = EndPoints(Curve=input_crv_2)  # -> Start, End
unit_z = UnitZ(Factor=ypsos_3)
negative = Negative(Value=frame_diametros_2)
move = Move(Geometry=end_points.End, Motion=unit_z)  # -> Geometry, Transform
rectangle_3pt = Rectangle3Pt(PointA=end_points.Start, PointB=end_points.End, PointC=move.Geometry)  # -> Rectangle, Length
plane_3pt = Plane3Pt(PointA=end_points.Start, PointB=end_points.End, PointC=move.Geometry)
brep_edges = BrepEdges(Brep=rectangle_3pt.Rectangle)  # -> Naked, Interior, NonManifold
curve_middle = CurveMiddle(Curve=brep_edges.Naked)
deconstruct = Deconstruct(Point=curve_middle)  # -> XComponent, YComponent, ZComponent
switch_3 = Data(switch_2)
sort_list = SortList(Keys=deconstruct.ZComponent, ValuesValuesA=brep_edges.Naked)  # -> Keys, reverse(ValuesValuesA)
split_list = SplitList(List=sort_list.ValuesValuesA, Index=switch_3)  # -> ListA, ListB
join_curves = JoinCurves(Curves=split_list.ListA, Preserve=False)
frame_platos_3 = Number(frame_platos_2)
frame_diametros_3 = Number(negative)
offset_curve = OffsetCurve(Curve=join_curves, Distance=frame_diametros_3, Plane=plane_3pt, Corners=1)
cluster = Cluster(curve=offset_curve)
ruled_surface = RuledSurface(CurveA=join_curves, CurveB=offset_curve)
amplitude = Amplitude(Vector=plane_3pt, Amplitude=frame_platos_3)
akriana_crvs = Data(cluster)
division = Division(A=amplitude, B=2)
extrude = Extrude(Base=ruled_surface, Direction=amplitude)
move_2 = Move(Geometry=akriana_crvs, Motion=division)  # -> Geometry, Transform
loft = Loft(Curves=move_2.Geometry, Options={Adjust=False, Closed=False, LoftEnds=0, LoftSimp=0, LoftType=0, Rebuild=10, Refit=0.01})
frame = Brep(extrude)
arithmos_anigmata_3 = Number(arithmos_anigmata_2)
divide_domain² = DivideDomain²(Domain=loft, UCount=arithmos_anigmata_3, VCount=Slider(1, range=1..5))
isotrim = Isotrim(Surface=loft, Domain=divide_domain²)
parathiro_diametros_3 = Number(parathiro_diametros_2)
negative_2 = Negative(Value=parathiro_diametros_3)
curve = Curve(simplify(flatten(isotrim)))
offset_curve_2 = OffsetCurve(Curve=simplify(isotrim), Distance=negative_2, Corners=1)  # -> flatten(Curve)
giali_frame_3 = Number(giali_frame_2)
merge = Merge(Data1=graft(curve), Data2=graft(offset_curve_2))
negative_3 = Negative(Value=giali_frame_3)
offset_curve_3 = OffsetCurve(Curve=simplify(offset_curve_2), Distance=negative_3, Corners=1)  # -> flatten(Curve)
loft_2 = Loft(Curves=merge, Options={Adjust=False, Closed=False, LoftEnds=0, LoftSimp=0, LoftType=0, Rebuild=10, Refit=0.01})
giali_platos_3 = Number(giali_platos_2)
merge_2 = Merge(Data1=graft(offset_curve_2), Data2=graft(offset_curve_3))
parathiro_platos_3 = Number(parathiro_platos_2)
loft_3 = Loft(Curves=merge_2, Options={Adjust=False, Closed=False, LoftEnds=0, LoftSimp=0, LoftType=0, Rebuild=10, Refit=0.01})
addition = Addition(A=giali_platos_3, B=0.02)
expression = Expression(x=parathiro_platos_3, Expression="x/2")
expression_2 = Expression(x=giali_platos_3, Expression="x/2")
expression_3 = Expression(x=addition, Expression="x/2")
negative_4 = Negative(Value=expression_2)
negative_5 = Negative(Value=expression)
negative_6 = Negative(Value=expression_3)
offset_surface = OffsetSurface(Surface=loft_2, Distance=expression, BothSides=negative_5, CreateSolid=True)
offset_surface_2 = OffsetSurface(Surface=loft_3, Distance=expression_3, BothSides=negative_6, CreateSolid=True)
offset_surface_3 = OffsetSurface(Surface=offset_curve_3, Distance=expression_2, BothSides=negative_4, CreateSolid=True)
merge_faces = MergeFaces(Brep=offset_surface)  # -> Breps, Before, After
giali_frame_4 = Brep(offset_surface_2)
parathira = Brep(merge_faces.Breps)
frame_2 = Brep(frame)
giali = Brep(offset_surface_3)
entwine = Entwine(Branch00=frame_2, Branch01=parathira, Branch02=giali_frame_4, Branch03=giali, FlattenInputs=True)
metal_material = ModelMaterial(<model material referenced from the Rhino model>)
glass_material = ModelMaterial(<model material referenced from the Rhino model>)
result = ClusterOutput(entwine)
entwine_2 = Entwine(Branch00=metal_material, Branch01=metal_material, Branch02=metal_material, Branch03=glass_material, FlattenInputs=True)
result_2 = ClusterOutput(entwine_2)

# ==== cluster Cluster_3
geometry = ClusterInput()
length = Length(Curve=geometry)  # -> simplify(Length)
list_item = ListItem(List=flatten(length), Index=0, Wrap=True)
division = Division(A=list_item, B=2)
negative = Negative(Value=division)
unit_z = UnitZ(Factor=negative)
move = Move(Geometry=geometry, Motion=unit_z)  # -> Geometry, Transform
curve_middle = CurveMiddle(Curve=move.Geometry)
list_item_2 = ListItem(List=curve_middle, Index=0, Wrap=True)  # -> Item, Item1
platos_ipostilomaton = ClusterInput()
line = Line(StartPoint=list_item_2.Item, EndPoint=list_item_2.Item1)
platos_ipostilomaton_2 = Number(platos_ipostilomaton)
vector_2pt = Vector2Pt(PointA=list_item_2.Item, PointB=list_item_2.Item1, Unitize=False)  # -> Vector, Length
count = ClusterInput()
division_2 = Division(A=platos_ipostilomaton_2, B=2)
divide_curve = DivideCurve(Curve=line, Count=count, Kinks=False)  # -> Points, Tangents, Parameters
negative_2 = Negative(Value=division_2)
panel = Panel("""-1
0""")
cull_index = CullIndex(List=divide_curve.Points, Indices=panel, Wrap=True)
number = Number(graft(division_2))
number_2 = Number(graft(negative_2))
amplitude = Amplitude(Vector=vector_2pt.Vector, Amplitude=number)
amplitude_2 = Amplitude(Vector=vector_2pt.Vector, Amplitude=number_2)
move_2 = Move(Geometry=cull_index, Motion=amplitude)  # -> Geometry, Transform
move_3 = Move(Geometry=cull_index, Motion=amplitude_2)  # -> Geometry, Transform
merge = Merge(Data1=move_2.Geometry, Data2=move_3.Geometry)
curve_closest_point = CurveClosestPoint(Point=merge, Curve=line)  # -> Point, Parameter, Distance
unit_z_2 = UnitZ(Factor=list_item)
shatter = Shatter(Curve=line, Parameters=curve_closest_point.Parameter)
parathira_platos = ClusterInput()
vector = ClusterInput()
extrude = Extrude(Base=shatter, Direction=unit_z_2)  # -> simplify(Extrusion)
parathira_platos_2 = Data(parathira_platos)
vector_2 = Data(vector)
area = Area(Geometry=extrude)  # -> Area, Centroid
arithmos_anigmaton = Number(count)
python_3_script = Python3Script(x=arithmos_anigmaton, w=parathira_platos_2)  # -> out, a; inputs x: Int32, w: Double
# ---------- python_3_script: Python ----------
x = int(x)  # αριθμός ανοιγμάτων
w = float(w)  # πλάτος ανοίγματος

offsets = []

for i in range(x):
    # κεντράρισμα: από -(x-1)/2 έως +(x-1)/2
    offset = (i - (x - 1) / 2.0) * w
    offsets.append(offset)

a = offsets
# ---------- end python_3_script ----------
start_point = Point(list_item_2.Item)
amplitude_3 = Amplitude(Vector=vector_2, Amplitude=python_3_script.a)
distance = Distance(PointA=start_point, PointB=area.Centroid)
sort_list = SortList(Keys=distance, ValuesValuesA=extrude)  # -> Keys, ValuesValuesA
data = Data(sort_list.ValuesValuesA)
domain_creator = Python3Script(x=arithmos_anigmaton)  # -> out, a; inputs x: String
# ---------- domain_creator: Python ----------
x = int(x)

domains = []

for i in range(x):
    real_i = i * 2
    
    if i == 0:
        domains.append("{0} to {1}".format(real_i, real_i + 1))
    elif i == x - 1:
        domains.append("{0} to {1}".format(real_i - 1, real_i))
    else:
        domains.append("{0} to {1}".format(real_i - 1, real_i + 1))

a = domains
# ---------- end domain_creator ----------
sub_list = SubList(List=data, Domain=domain_creator.a, Wrap=False)  # -> List, Index
region_union = RegionUnion(Curves=sub_list.List)  # -> simplify(Result)
trim_tree = TrimTree(Tree=region_union, Depth=1)
move_4 = Move(Geometry=trim_tree, Motion=amplitude_3)  # -> Geometry, Transform
parathira_surface = Data(move_4.Geometry)
parathira_surface_2 = ClusterOutput(parathira_surface)

# ==== cluster Cluster_4
curves = ClusterInput()
loft = Loft(Curves=curves, Options={Adjust=False, Closed=False, LoftEnds=0, LoftSimp=0, LoftType=0, Rebuild=10, Refit=0.01})
arithmos_anigmata = ClusterInput()
arithmos_anigmata_2 = Number(arithmos_anigmata)
divide_domain² = DivideDomain²(Domain=loft, UCount=arithmos_anigmata_2, VCount="1")
isotrim = Isotrim(Surface=loft, Domain=divide_domain²)
surface = ClusterOutput(isotrim)

# ==== cluster Cluster_5
ipostiloma_diametros = ClusterInput()
switch_porta_parathira = ClusterInput()
switch_ipostilomata = ClusterInput()
parathiro_diametros = ClusterInput()
arithmos_anigmata = ClusterInput()
ipostiloma_platos = ClusterInput()
input_crv = ClusterInput()
frame_diametros = ClusterInput()
parathiro_platos = ClusterInput()
frame_platos = ClusterInput()
giali_platos = ClusterInput()
giali_frame = ClusterInput()
ypsos = ClusterInput()
ipostiloma_diametros_2 = Number(ipostiloma_diametros)
switch_porta_parathira_2 = Data(switch_porta_parathira)
switch_ipostilomata_2 = Data(switch_ipostilomata)
parathiro_diametros_2 = Number(parathiro_diametros)
arithmos_anigmata_2 = Number(arithmos_anigmata)
ipostiloma_platos_2 = Number(ipostiloma_platos)
input_crv_2 = Curve(graft(input_crv))
frame_diametros_2 = Number(frame_diametros)
parathiro_platos_2 = Number(parathiro_platos)
frame_platos_2 = Number(frame_platos)
giali_platos_2 = Number(giali_platos)
giali_frame_2 = Number(giali_frame)
ypsos_2 = Number(ypsos)
ypsos_3 = Number(ypsos_2)
end_points = EndPoints(Curve=input_crv_2)  # -> Start, End
unit_z = UnitZ(Factor=ypsos_3)
negative = Negative(Value=frame_diametros_2)
move = Move(Geometry=end_points.End, Motion=unit_z)  # -> Geometry, Transform
rectangle_3pt = Rectangle3Pt(PointA=end_points.Start, PointB=end_points.End, PointC=move.Geometry)  # -> Rectangle, Length
plane_3pt = Plane3Pt(PointA=end_points.Start, PointB=end_points.End, PointC=move.Geometry)
brep_edges = BrepEdges(Brep=rectangle_3pt.Rectangle)  # -> Naked, Interior, NonManifold
curve_middle = CurveMiddle(Curve=brep_edges.Naked)
deconstruct = Deconstruct(Point=curve_middle)  # -> XComponent, YComponent, ZComponent
switch = Data(switch_porta_parathira_2)
sort_list = SortList(Keys=deconstruct.ZComponent, ValuesValuesA=brep_edges.Naked)  # -> Keys, reverse(ValuesValuesA)
split_list = SplitList(List=sort_list.ValuesValuesA, Index=switch)  # -> ListA, ListB
join_curves = JoinCurves(Curves=split_list.ListA, Preserve=False)
frame_platos_3 = Number(frame_platos_2)
frame_diametros_3 = Number(negative)
offset_curve = OffsetCurve(Curve=join_curves, Distance=frame_diametros_3, Plane=plane_3pt, Corners=1)
merge = Merge(Data1=simplify(graft(join_curves)), Data2=simplify(graft(offset_curve)))
cluster = Cluster(curve=offset_curve)
amplitude = Amplitude(Vector=plane_3pt, Amplitude=frame_platos_3)
loft = Loft(Curves=merge, Options={Adjust=False, Closed=False, LoftEnds=0, LoftSimp=0, LoftType=0, Rebuild=10, Refit=0.01})
akriana_crvs = Data(cluster)
division = Division(A=amplitude, B=2)
extrude = Extrude(Base=loft, Direction=amplitude)
move_2 = Move(Geometry=akriana_crvs, Motion=division)  # -> Geometry, Transform
ipostiloma_diametros_3 = Number(ipostiloma_diametros_2)
arithmos_anigmata_3 = Number(arithmos_anigmata_2)
frame = Brep(extrude)
switch_ipostilomata_3 = Data(switch_ipostilomata_2)
cluster_2 = Cluster_4(curves=move_2.Geometry, arithmos_anigmata=arithmos_anigmata_3)
me_ipostilomata = Me_ipostilomata(geometry=move_2.Geometry, count=arithmos_anigmata_3, platos_ipostilomaton=ipostiloma_diametros_3)  # -> list_a, list_b
error = Panel("55")
weave = Weave(Pattern=switch_ipostilomata_3, Stream0=error, Stream1=me_ipostilomata.list_b, NullGaps=False)
weave_2 = Weave(Pattern=switch_ipostilomata_3, Stream0=cluster_2, Stream1=me_ipostilomata.list_a, NullGaps=False)
parathiro_diametros_3 = Number(parathiro_diametros_2)
ipostilomata_srf = Data(weave)
negative_2 = Negative(Value=parathiro_diametros_3)
curve = Curve(simplify(flatten(weave_2)))
offset_curve_2 = OffsetCurve(Curve=simplify(weave_2), Distance=negative_2, Corners=1)  # -> flatten(Curve)
giali_frame_3 = Number(giali_frame_2)
merge_2 = Merge(Data1=graft(curve), Data2=graft(offset_curve_2))
negative_3 = Negative(Value=giali_frame_3)
offset_curve_3 = OffsetCurve(Curve=simplify(offset_curve_2), Distance=negative_3, Corners=1)  # -> flatten(Curve)
loft_2 = Loft(Curves=merge_2, Options={Adjust=False, Closed=False, LoftEnds=0, LoftSimp=0, LoftType=0, Rebuild=10, Refit=0.01})
giali_platos_3 = Number(giali_platos_2)
merge_3 = Merge(Data1=graft(offset_curve_2), Data2=graft(offset_curve_3))
parathiro_platos_3 = Number(parathiro_platos_2)
loft_3 = Loft(Curves=merge_3, Options={Adjust=False, Closed=False, LoftEnds=0, LoftSimp=0, LoftType=0, Rebuild=10, Refit=0.01})
addition = Addition(A=giali_platos_3, B=0.02)
ipostiloma_platos_3 = Number(ipostiloma_platos_2)
expression = Expression(x=parathiro_platos_3, Expression="x/2")
expression_2 = Expression(x=giali_platos_3, Expression="x/2")
expression_3 = Expression(x=ipostiloma_platos_3, Expression="x/2")
expression_4 = Expression(x=addition, Expression="x/2")
negative_4 = Negative(Value=expression_2)
negative_5 = Negative(Value=expression_3)
negative_6 = Negative(Value=expression)
negative_7 = Negative(Value=expression_4)
offset_surface = OffsetSurface(Surface=loft_2, Distance=expression, BothSides=negative_6, CreateSolid=True)
offset_surface_2 = OffsetSurface(Surface=loft_3, Distance=expression_4, BothSides=negative_7, CreateSolid=True)
offset_surface_3 = OffsetSurface(Surface=offset_curve_3, Distance=expression_2, BothSides=negative_4, CreateSolid=True)
offset_surface_4 = OffsetSurface(Surface=ipostilomata_srf, Distance=expression_3, BothSides=negative_5, CreateSolid=True)
solid_union = SolidUnion(Breps=offset_surface)
solid_union_2 = SolidUnion(Breps=offset_surface_2)
ipostiloma_platos_4 = Brep(offset_surface_4)
giali_frame_4 = Brep(solid_union_2)
parathira = Brep(solid_union)
frame_2 = Brep(frame)
giali = Brep(offset_surface_3)
entwine = Entwine(
    Branch00=frame_2,
    Branch01=parathira,
    Branch02=giali_frame_4,
    Branch03=giali,
    Branch04=ipostiloma_platos_4,
    FlattenInputs=True)
metal_material_skouro = ModelMaterial(<model material referenced from the Rhino model>)
metal_material_polish = ModelMaterial(<model material referenced from the Rhino model>)
glass_material = ModelMaterial(<model material referenced from the Rhino model>)
result = ClusterOutput(entwine)
entwine_2 = Entwine(
    Branch00=metal_material_skouro,
    Branch01=metal_material_polish,
    Branch02=metal_material_polish,
    Branch03=glass_material,
    Branch04=metal_material_skouro,
    FlattenInputs=True)
result_2 = ClusterOutput(entwine_2)

# ==== cluster Cluster_7
ipostiloma_diametros = ClusterInput()
switch_porta_parathira = ClusterInput()
switch_ipostilomata = ClusterInput()
parathiro_diametros = ClusterInput()
arithmos_anigmata = ClusterInput()
ipostiloma_platos = ClusterInput()
frame_diametros = ClusterInput()
parathiro_platos = ClusterInput()
flip_curve = ClusterInput()
input_crv = ClusterInput()
frame_platos = ClusterInput()
giali_platos = ClusterInput()
giali_frame = ClusterInput()
ypsos = ClusterInput()
panel = Panel("1")
ipostiloma_diametros_2 = Number(ipostiloma_diametros)
switch_porta_parathira_2 = Data(switch_porta_parathira)
switch_ipostilomata_2 = Data(switch_ipostilomata)
parathiro_diametros_2 = Number(parathiro_diametros)
arithmos_anigmata_2 = Number(arithmos_anigmata)
input_crv_2 = Curve(graft(input_crv))
ipostiloma_platos_2 = Number(ipostiloma_platos)
flip_curve_2 = Number(flip_curve)
frame_diametros_2 = Number(frame_diametros)
parathiro_platos_2 = Number(parathiro_platos)
frame_platos_2 = Number(frame_platos)
giali_platos_2 = Number(giali_platos)
giali_frame_2 = Number(giali_frame)
ypsos_2 = Number(ypsos)
flip_curve_3 = FlipCurve(Curve=input_crv_2)  # -> Curve, Flag
ypsos_3 = Number(ypsos_2)
pick_n_choose = PickNChoose(Pattern=flip_curve_2, Stream0=input_crv_2, Stream1=flip_curve_3.Curve)
unit_z = UnitZ(Factor=ypsos_3)
negative = Negative(Value=frame_diametros_2)
end_points = EndPoints(Curve=pick_n_choose)  # -> Start, End
move = Move(Geometry=end_points.End, Motion=unit_z)  # -> Geometry, Transform
rectangle_3pt = Rectangle3Pt(PointA=end_points.Start, PointB=end_points.End, PointC=move.Geometry)  # -> Rectangle, Length
plane_3pt = Plane3Pt(PointA=end_points.Start, PointB=end_points.End, PointC=move.Geometry)
brep_edges = BrepEdges(Brep=rectangle_3pt.Rectangle)  # -> Naked, Interior, NonManifold
curve_middle = CurveMiddle(Curve=brep_edges.Naked)
deconstruct = Deconstruct(Point=curve_middle)  # -> XComponent, YComponent, ZComponent
switch = Data(switch_porta_parathira_2)
sort_list = SortList(Keys=deconstruct.ZComponent, ValuesValuesA=brep_edges.Naked)  # -> Keys, reverse(ValuesValuesA)
split_list = SplitList(List=sort_list.ValuesValuesA, Index=switch)  # -> ListA, ListB
join_curves = JoinCurves(Curves=split_list.ListA, Preserve=False)
frame_platos_3 = Number(frame_platos_2)
frame_diametros_3 = Number(negative)
offset_curve = OffsetCurve(Curve=join_curves, Distance=frame_diametros_3, Plane=plane_3pt, Corners=1)
trim_tree = TrimTree(Tree=offset_curve, Depth=1)
merge = Merge(Data1=simplify(graft(join_curves)), Data2=simplify(graft(trim_tree)))
cluster = Cluster(curve=offset_curve)
amplitude = Amplitude(Vector=plane_3pt, Amplitude=frame_platos_3)
loft = Loft(Curves=merge, Options={Adjust=False, Closed=False, LoftEnds=0, LoftSimp=0, LoftType=0, Rebuild=10, Refit=0.01})
division = Division(A=amplitude, B=2)
akriana_crvs = Data(cluster)
extrude = Extrude(Base=loft, Direction=amplitude)
move_2 = Move(Geometry=akriana_crvs, Motion=division)  # -> Geometry, Transform
ipostiloma_diametros_3 = Number(ipostiloma_diametros_2)
parathiro_diametros_3 = Number(parathiro_diametros_2)
switch_ipostilomata_3 = Data(switch_ipostilomata_2)
arithmos_anigmata_3 = Number(arithmos_anigmata_2)
frame = Brep(extrude)
vector = Vector(plane_3pt)
cluster_2 = Me_ipostilomata(geometry=move_2.Geometry, count=arithmos_anigmata_3, platos_ipostilomaton=ipostiloma_diametros_3)  # -> list_a, list_b
cluster_3 = Cluster_6(
    geometry=move_2.Geometry,
    count=arithmos_anigmata_3,
    platos_ipostilomaton=parathiro_diametros_3,
    parathira_platos=parathiro_platos_2,
    vector=vector)
cluster_4 = Cluster_4(curves=move_2.Geometry, arithmos_anigmata=arithmos_anigmata_3)
error = Panel("55")
weave = Weave(Pattern=switch_ipostilomata_3, Stream0=error, Stream1=cluster_2.list_b, NullGaps=False)
entwine = Entwine(Branch00=cluster_4, Branch01=cluster_2.list_a, Branch02=cluster_3, FlattenInputs=True)
flip_matrix = FlipMatrix(Data=entwine)
list_item = ListItem(List=flip_matrix, Index=switch_ipostilomata_3, Wrap=True)  # -> flatten(Item)
negative_2 = Negative(Value=parathiro_diametros_3)
ipostilomata_srf = Data(weave)
offset_curve_2 = OffsetCurve(Curve=simplify(list_item), Distance=negative_2, Corners=1)  # -> flatten(Curve)
curve = Curve(simplify(flatten(list_item)))
giali_frame_3 = Number(giali_frame_2)
merge_2 = Merge(Data1=graft(curve), Data2=graft(offset_curve_2))
negative_3 = Negative(Value=giali_frame_3)
offset_curve_3 = OffsetCurve(Curve=simplify(offset_curve_2), Distance=negative_3, Corners=1)  # -> flatten(Curve)
loft_2 = Loft(Curves=merge_2, Options={Adjust=False, Closed=False, LoftEnds=0, LoftSimp=0, LoftType=0, Rebuild=10, Refit=0.01})
giali_platos_3 = Number(giali_platos_2)
merge_3 = Merge(Data1=graft(offset_curve_2), Data2=graft(offset_curve_3))
parathiro_platos_3 = Number(parathiro_platos_2)
loft_3 = Loft(Curves=merge_3, Options={Adjust=False, Closed=False, LoftEnds=0, LoftSimp=0, LoftType=0, Rebuild=10, Refit=0.01})
addition = Addition(A=giali_platos_3, B=0.02)
ipostiloma_platos_3 = Number(ipostiloma_platos_2)
expression = Expression(x=parathiro_platos_3, Expression="x/2")
expression_2 = Expression(x=giali_platos_3, Expression="x/2")
expression_3 = Expression(x=ipostiloma_platos_3, Expression="x/2")
expression_4 = Expression(x=addition, Expression="x/2")
negative_4 = Negative(Value=expression_2)
negative_5 = Negative(Value=expression_3)
negative_6 = Negative(Value=expression)
negative_7 = Negative(Value=expression_4)
offset_surface = OffsetSurface(Surface=loft_2, Distance=expression, BothSides=negative_6, CreateSolid=True)
offset_surface_2 = OffsetSurface(Surface=loft_3, Distance=expression_4, BothSides=negative_7, CreateSolid=True)
offset_surface_3 = OffsetSurface(Surface=offset_curve_3, Distance=expression_2, BothSides=negative_4, CreateSolid=True)
offset_surface_4 = OffsetSurface(Surface=ipostilomata_srf, Distance=expression_3, BothSides=negative_5, CreateSolid=True)
solid_union = SolidUnion(Breps=offset_surface)
solid_union_2 = SolidUnion(Breps=offset_surface_2)
ipostiloma_platos_4 = Brep(offset_surface_4)
giali_frame_4 = Brep(solid_union_2)
parathira = Brep(solid_union)
frame_2 = Brep(frame)
giali = Brep(offset_surface_3)
colour_swatch = ColourSwatch(SwatchColor=RGB(110, 110, 110))
colour_swatch_2 = ColourSwatch(SwatchColor=RGB(163, 163, 163))
entwine_2 = Entwine(
    Branch00=frame_2,
    Branch01=parathira,
    Branch02=giali_frame_4,
    Branch03=giali,
    Branch04=ipostiloma_platos_4,
    FlattenInputs=True)
result = ClusterOutput(entwine_2)
entwine_3 = Entwine(
    Branch00=colour_swatch,
    Branch01=colour_swatch_2,
    Branch02=colour_swatch_2,
    Branch03=ColourSwatch(SwatchColor=RGBA(143, 216, 255, 126)),
    Branch04=colour_swatch,
    FlattenInputs=True)
result_2 = ClusterOutput(entwine_3)

# ==== cluster Me_ipostilomata
geometry = ClusterInput()
length = Length(Curve=geometry)  # -> simplify(Length)
list_item = ListItem(List=flatten(length), Index=0, Wrap=True)
division = Division(A=list_item, B=2)
negative = Negative(Value=division)
unit_z = UnitZ(Factor=negative)
move = Move(Geometry=geometry, Motion=unit_z)  # -> Geometry, Transform
curve_middle = CurveMiddle(Curve=move.Geometry)
list_item_2 = ListItem(List=curve_middle, Index=0, Wrap=True)  # -> Item, Item1
platos_ipostilomaton = ClusterInput()
line = Line(StartPoint=list_item_2.Item, EndPoint=list_item_2.Item1)
platos_ipostilomaton_2 = Number(platos_ipostilomaton)
vector_2pt = Vector2Pt(PointA=list_item_2.Item, PointB=list_item_2.Item1, Unitize=False)  # -> Vector, Length
count = ClusterInput()
division_2 = Division(A=platos_ipostilomaton_2, B=2)
divide_curve = DivideCurve(Curve=line, Count=count, Kinks=False)  # -> Points, Tangents, Parameters
panel = Panel("""-1
0""")
negative_2 = Negative(Value=division_2)
cull_index = CullIndex(List=divide_curve.Points, Indices=panel, Wrap=True)
number = Number(graft(division_2))
number_2 = Number(graft(negative_2))
amplitude = Amplitude(Vector=vector_2pt.Vector, Amplitude=number)
amplitude_2 = Amplitude(Vector=vector_2pt.Vector, Amplitude=number_2)
move_2 = Move(Geometry=cull_index, Motion=amplitude)  # -> Geometry, Transform
move_3 = Move(Geometry=cull_index, Motion=amplitude_2)  # -> Geometry, Transform
merge = Merge(Data1=move_2.Geometry, Data2=move_3.Geometry)
curve_closest_point = CurveClosestPoint(Point=merge, Curve=line)  # -> Point, Parameter, Distance
unit_z_2 = UnitZ(Factor=list_item)
shatter = Shatter(Curve=line, Parameters=curve_closest_point.Parameter)
extrude = Extrude(Base=shatter, Direction=unit_z_2)  # -> simplify(Extrusion)
area = Area(Geometry=extrude)  # -> Area, Centroid
round_to_decimal_place = RoundToDecimalPlace(NumberX=area.Area, DecimalPlace="1", RoundType=0)  # -> Rounded, Difference
sort_list = SortList(Keys=round_to_decimal_place.Rounded)  # -> Keys, ValuesValuesA
list_item_3 = ListItem(List=sort_list.Keys, Index=0, Wrap=True)
larger_than = LargerThan(FirstNumber=round_to_decimal_place.Rounded, SecondNumber=list_item_3)  # -> LargerThan, OrEqualTo
dispatch = Dispatch(List=extrude, DispatchPattern=larger_than.LargerThan)  # -> ListA, ListB
list_a = ClusterOutput(dispatch.ListA)
list_b = ClusterOutput(dispatch.ListB)

# ==== cluster Cluster_6
geometry = ClusterInput()
length = Length(Curve=geometry)  # -> simplify(Length)
list_item = ListItem(List=flatten(length), Index=0, Wrap=True)
division = Division(A=list_item, B=2)
negative = Negative(Value=division)
unit_z = UnitZ(Factor=negative)
move = Move(Geometry=geometry, Motion=unit_z)  # -> Geometry, Transform
curve_middle = CurveMiddle(Curve=move.Geometry)
list_item_2 = ListItem(List=curve_middle, Index=0, Wrap=True)  # -> Item, Item1
platos_ipostilomaton = ClusterInput()
line = Line(StartPoint=list_item_2.Item, EndPoint=list_item_2.Item1)
platos_ipostilomaton_2 = Number(platos_ipostilomaton)
vector_2pt = Vector2Pt(PointA=list_item_2.Item, PointB=list_item_2.Item1, Unitize=False)  # -> Vector, Length
count = ClusterInput()
division_2 = Division(A=platos_ipostilomaton_2, B=2)
divide_curve = DivideCurve(Curve=line, Count=count, Kinks=False)  # -> Points, Tangents, Parameters
negative_2 = Negative(Value=division_2)
panel = Panel("""-1
0""")
cull_index = CullIndex(List=divide_curve.Points, Indices=panel, Wrap=True)
number = Number(graft(division_2))
number_2 = Number(graft(negative_2))
amplitude = Amplitude(Vector=vector_2pt.Vector, Amplitude=number)
amplitude_2 = Amplitude(Vector=vector_2pt.Vector, Amplitude=number_2)
move_2 = Move(Geometry=cull_index, Motion=amplitude)  # -> Geometry, Transform
move_3 = Move(Geometry=cull_index, Motion=amplitude_2)  # -> Geometry, Transform
merge = Merge(Data1=move_2.Geometry, Data2=move_3.Geometry)
curve_closest_point = CurveClosestPoint(Point=merge, Curve=line)  # -> Point, Parameter, Distance
unit_z_2 = UnitZ(Factor=list_item)
shatter = Shatter(Curve=line, Parameters=curve_closest_point.Parameter)
parathira_platos = ClusterInput()
vector = ClusterInput()
extrude = Extrude(Base=shatter, Direction=unit_z_2)  # -> simplify(Extrusion)
parathira_platos_2 = Data(parathira_platos)
vector_2 = Data(vector)
area = Area(Geometry=extrude)  # -> Area, Centroid
arithmos_anigmaton = Number(count)
python_3_script = Python3Script(x=arithmos_anigmaton, w=parathira_platos_2)  # -> out, a; inputs x: Int32, w: Double; same code as python_3_script
start_point = Point(list_item_2.Item)
amplitude_3 = Amplitude(Vector=vector_2, Amplitude=python_3_script.a)
distance = Distance(PointA=start_point, PointB=area.Centroid)
sort_list = SortList(Keys=distance, ValuesValuesA=extrude)  # -> Keys, ValuesValuesA
data = Data(sort_list.ValuesValuesA)
domain_creator = Python3Script(x=arithmos_anigmaton)  # -> out, a; inputs x: String; same code as domain_creator
sub_list = SubList(List=data, Domain=domain_creator.a, Wrap=False)  # -> List, Index
region_union = RegionUnion(Curves=simplify(sub_list.List))
trim_tree = TrimTree(Tree=region_union, Depth=1)
move_4 = Move(Geometry=trim_tree, Motion=graft(amplitude_3))  # -> Geometry, Transform
parathira_surface = Data(move_4.Geometry)
parathira_surface_2 = ClusterOutput(parathira_surface)
