# Grasshopper definition grass_OBJ_distribution.gh (Grasshopper 1.0.8)

surface = Surface(<surface referenced from the Rhino model>)  # disabled
number_slider = Slider(2, range=0..2)  # disabled
number_slider_2 = Slider(0, range=0..10)  # disabled
number_slider_3 = Slider(58, range=0..100)  # disabled
number_slider_4 = Slider(0.1, range=0..0.5)  # disabled
input_surface = Surface([<surface referenced from the Rhino model> x2])  # disabled
input_brep = Brep([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])  # disabled

# ----
# version_1
# provlima-an to input surface
# exei tripa to offset surface
# den litura
# 
# epomeni dokimi- na paroume
# to boundary tou srf kai na dosoume
#  auto sto offset
# **to ''input_brep'' prepi na
#  vriskete sto 0.0
number_slider_5 = Slider(0.8, range=0..2)
input_surface_2 = Surface(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)
input_brep_2 = Brep([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])
cluster = Cluster(
    brep_tet_dentro=input_brep_2,
    input_surface=input_surface_2,
    offset_distance=number_slider_5,
    arithmos_antikimenos=Slider(21, range=0..100),
    rotation=Slider(10, range=0..10),
    scale=Slider(0.2, range=0..0.5))  # -> result, result_2
# provlima-an to offset_distance
# einai poli megalo ta antikim
# ena metaferonte sto eksoteriko
#  srf
# 
# epomeni dokimi- na ginonte
# sort me tin apostasi apo to
#  kentro
custom_preview = CustomPreview(Geometry=cluster.result, Material=cluster.result_2)

arithmos_antikimenos = Number(number_slider_3)  # disabled
input_surface_3 = Surface(graft(input_surface))  # disabled
input_brep_tetragono = Brep([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])
brep_tet_dentro = Brep(input_brep)  # disabled
offset_distance = Number(number_slider)  # disabled
rotation = Number(number_slider_2)  # disabled
scale = Number(number_slider_4)  # disabled
group = Group(Geometry=brep_tet_dentro)  # disabled
offset_distance_2 = Number(offset_distance)  # disabled
arithmos_antikimenos_2 = Number(arithmos_antikimenos)  # disabled
group_antikimeno = Group(group)  # disabled
offset_on_srf = OffsetOnSrf(Curve=input_surface_3, Distance=offset_distance_2, Surface=input_surface_3)  # disabled
surface_split = SurfaceSplit(Surface=input_surface_3, Curves=offset_on_srf)  # disabled
area = Area(Geometry=surface_split)  # -> Area, Centroid; disabled
sort_list = SortList(Keys=area.Area, ValuesValuesA=surface_split)  # -> Keys, reverse(ValuesValuesA); disabled
list_item = ListItem(List=sort_list.ValuesValuesA, Index=0, Wrap=True)  # disabled
scale_2 = Number(scale)  # disabled
populate_geometry = PopulateGeometry(Geometry=list_item, Count=arithmos_antikimenos_2, Seed=1)  # -> simplify(Population); disabled
negative = Negative(Value=scale_2)  # disabled
panel = Panel("1")  # disabled
series = Series(Start=0, Step=1, Count=arithmos_antikimenos_2)  # disabled
rotation_2 = Number(rotation)  # disabled
xy_plane = XYPlane(Origin=populate_geometry)  # disabled
group_antikimeno_2 = Group(group_antikimeno)  # disabled
addition = Addition(A=negative, B=panel)  # disabled
addition_2 = Addition(A=scale_2, B=panel)  # disabled
multiplication = Multiplication(A=series, B=rotation_2)  # disabled
xy_plane_2 = XYPlane(Origin=Point(0, 0, 0))  # disabled
construct_domain = ConstructDomain(DomainStart=addition, DomainEnd=addition_2)  # disabled
rotate = Rotate(Geometry=xy_plane, Angle=multiplication, Plane=xy_plane)  # -> Geometry, Transform; disabled
bounds = Bounds(Numbers=series)  # disabled
orient = Orient(Geometry=group_antikimeno_2, Source=xy_plane_2, Target=rotate.Geometry)  # -> Geometry, Transform; disabled
remap_numbers = RemapNumbers(Value=series, Source=bounds, Target=construct_domain)  # -> Mapped, Clipped; disabled
panel_2 = Panel("5")  # disabled
jitter = Jitter(List=remap_numbers.Mapped, Jitter=1, Seed=2)  # -> Values, Indices; disabled
jitter_2 = Jitter(List=remap_numbers.Mapped, Jitter=1, Seed=panel_2)  # -> Values, Indices; disabled
scale_nu = ScaleNU(
    Geometry=orient.Geometry,
    Plane=rotate.Geometry,
    ScaleX=jitter.Values,
    ScaleY=jitter_2.Values,
    ScaleZ=remap_numbers.Mapped)  # -> Geometry, Transform; disabled

data = Data(simplify(scale_nu.Geometry))  # disabled
ungroup = Ungroup(Group=data)  # disabled
colour_swatch = ColourSwatch(SwatchColor=RGB(145, 145, 145))  # disabled
colour_swatch_2 = ColourSwatch(SwatchColor=RGB(103, 133, 49))  # disabled
list_item_2 = ListItem(List=ungroup, Index=0, Wrap=True)  # -> Item, Item1, Item2; disabled
entwine = Entwine(Branch00=list_item_2.Item, Branch01=list_item_2.Item1, FlattenInputs=True)  # disabled
entwine_2 = Entwine(Branch00=colour_swatch, Branch01=colour_swatch_2, FlattenInputs=True)  # disabled
custom_preview_2 = CustomPreview(Geometry=entwine, Material=entwine_2)  # disabled

# ==== cluster Cluster
arithmos_antikimenos = ClusterInput()
input_surface = ClusterInput()
brep_tet_dentro = ClusterInput()
offset_distance = ClusterInput()
rotation = ClusterInput()
scale = ClusterInput()
arithmos_antikimenos_2 = Number(arithmos_antikimenos)
input_surface_2 = Surface(graft(input_surface))
brep_tet_dentro_2 = Brep(brep_tet_dentro)
offset_distance_2 = Number(offset_distance)
rotation_2 = Number(rotation)
scale_2 = Number(scale)
group = Group(Geometry=brep_tet_dentro_2)
offset_distance_3 = Number(offset_distance_2)
arithmos_antikimenos_3 = Number(arithmos_antikimenos_2)
group_antikimeno = Group(group)
offset_on_srf = OffsetOnSrf(Curve=input_surface_2, Distance=offset_distance_3, Surface=input_surface_2)
surface_split = SurfaceSplit(Surface=input_surface_2, Curves=offset_on_srf)
area = Area(Geometry=surface_split)  # -> Area, Centroid
sort_list = SortList(Keys=area.Area, ValuesValuesA=surface_split)  # -> Keys, reverse(ValuesValuesA)
list_item = ListItem(List=sort_list.ValuesValuesA, Index=0, Wrap=True)
scale_3 = Number(scale_2)
populate_geometry = PopulateGeometry(Geometry=list_item, Count=arithmos_antikimenos_3, Seed=1)  # -> simplify(Population)
negative = Negative(Value=scale_3)
series = Series(Start=0, Step=1, Count=arithmos_antikimenos_3)
rotation_3 = Number(rotation_2)
xy_plane = XYPlane(Origin=populate_geometry)
group_antikimeno_2 = Group(group_antikimeno)
addition = Addition(A=negative, B="1")
addition_2 = Addition(A=scale_3, B="1")
multiplication = Multiplication(A=series, B=rotation_3)
xy_plane_2 = XYPlane(Origin=Point(0, 0, 0))
construct_domain = ConstructDomain(DomainStart=addition, DomainEnd=addition_2)
rotate = Rotate(Geometry=xy_plane, Angle=multiplication, Plane=xy_plane)  # -> Geometry, Transform
bounds = Bounds(Numbers=series)
orient = Orient(Geometry=group_antikimeno_2, Source=xy_plane_2, Target=rotate.Geometry)  # -> Geometry, Transform
remap_numbers = RemapNumbers(Value=series, Source=bounds, Target=construct_domain)  # -> Mapped, Clipped
jitter = Jitter(List=remap_numbers.Mapped, Jitter=1, Seed=2)  # -> Values, Indices
jitter_2 = Jitter(List=remap_numbers.Mapped, Jitter=1, Seed="5")  # -> Values, Indices
scale_nu = ScaleNU(
    Geometry=orient.Geometry,
    Plane=rotate.Geometry,
    ScaleX=jitter.Values,
    ScaleY=jitter_2.Values,
    ScaleZ=remap_numbers.Mapped)  # -> Geometry, Transform
data = Data(simplify(scale_nu.Geometry))
ungroup = Ungroup(Group=data)
list_item_2 = ListItem(List=ungroup, Index=0, Wrap=True)  # -> Item, Item1, Item2
entwine = Entwine(Branch00=list_item_2.Item, Branch01=list_item_2.Item1, Branch02=input_surface_2, FlattenInputs=True)
entwine_2 = Entwine(
    Branch00=ColourSwatch(SwatchColor=RGB(145, 145, 145)),
    Branch01=ColourSwatch(SwatchColor=RGB(103, 133, 49)),
    Branch02=ColourSwatch(SwatchColor=RGB(122, 104, 104)),
    FlattenInputs=True)
result = ClusterOutput(entwine)
result_2 = ClusterOutput(entwine_2)
