# Grasshopper definition orofi.gh (Grasshopper 1.0.8)
# plug-ins: Squisher, Pufferfish, OpenNest

surface = Surface(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)
list_item = ListItem(List=flatten(surface), Index=0, Wrap=True)
x_ksila = Slider(5, range=0..10)
y_ksila = Slider(4, range=0..10)
surface_2 = Surface(graft([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]))
merge = Merge(Data1=surface_2, Data2=surface)  # -> simplify(flatten(Result))
surface_3 = Surface(graft(merge))
deconstruct_brep = DeconstructBrep(Brep=surface_2)  # -> Faces, Edges, Vertices; disabled
addition = Addition(A=x_ksila, B=1)
addition_2 = Addition(A=y_ksila, B=1)
ypsos_orofis = Number(Slider(0.3, range=0.1..2))
platos_tixos = Number(Slider(0.2, range=0.1..1))
offset = Number(Slider(0.6, range=0.1..1))
ypsos_tixos = Number(Slider(3, range=2..3.5))
divide_domain² = DivideDomain²(Domain=surface_3, UCount=x_ksila, VCount="1")
divide_domain²_2 = DivideDomain²(Domain=surface_3, UCount="1", VCount=y_ksila)
length = Length(Curve=deconstruct_brep.Edges)  # disabled
ypsos_orofis_2 = Number(ypsos_orofis)
sort_list = SortList(Keys=length, ValuesValuesA=deconstruct_brep.Edges)  # -> Keys, ValuesValuesA; disabled
unit_z = UnitZ(Factor=ypsos_orofis_2)
isotrim = Isotrim(Surface=surface_3, Domain=divide_domain²)
isotrim_2 = Isotrim(Surface=surface_3, Domain=divide_domain²_2)
surface_points = SurfacePoints(Surface=surface_3)  # -> Points, Weights, Greville, UCount, VCount
extrude = Extrude(Base=surface_3, Direction=unit_z)
perigrama_crv = Curve(surface_3)
list_item_2 = ListItem(List=sort_list.ValuesValuesA, Index=0, Wrap=True)  # -> Item, Item1, Item2, Item3; disabled
offset_2 = Number(offset)
curve_middle = CurveMiddle(Curve=list_item_2.Item)  # disabled
curve_middle_2 = CurveMiddle(Curve=list_item_2.Item1)  # disabled
curve_middle_3 = CurveMiddle(Curve=list_item_2.Item2)  # disabled
curve_middle_4 = CurveMiddle(Curve=list_item_2.Item3)  # disabled
platos_tixos_2 = Number(platos_tixos)

explode = Explode(Curve=isotrim, Recursive=True)  # -> Segments, Vertices
length_2 = Length(Curve=explode.Segments)
sort_list_2 = SortList(Keys=length_2, ValuesValuesA=explode.Segments)  # -> Keys, reverse(ValuesValuesA)
list_item_3 = ListItem(List=sort_list_2.ValuesValuesA, Index=0, Wrap=True)  # -> Item, Item1
curve = Curve(flatten([list_item_3.Item1, list_item_3.Item]))
curve_middle_5 = CurveMiddle(Curve=curve)
cull_duplicates = CullDuplicates(Points=curve_middle_5, Tolerance=0.1, CullMode=3)  # -> Points, Indices, Valence
closest_point = ClosestPoint(Point=cull_duplicates.Points, Cloud=curve_middle_5)  # -> ClosestPoint, CPIndex, Distance
list_item_4 = ListItem(List=curve, Index=closest_point.CPIndex, Wrap=True)

explode_2 = Explode(Curve=isotrim_2, Recursive=True)  # -> Segments, Vertices
length_3 = Length(Curve=explode_2.Segments)
sort_list_3 = SortList(Keys=length_3, ValuesValuesA=explode_2.Segments)  # -> Keys, reverse(ValuesValuesA)
list_item_5 = ListItem(List=sort_list_3.ValuesValuesA, Index=0, Wrap=True)  # -> Item, Item1
curve_2 = Curve(flatten([list_item_5.Item1, list_item_5.Item]))
curve_middle_6 = CurveMiddle(Curve=curve_2)
cull_duplicates_2 = CullDuplicates(Points=curve_middle_6, Tolerance=0.1, CullMode=3)  # -> Points, Indices, Valence
closest_point_2 = ClosestPoint(Point=cull_duplicates_2.Points, Cloud=curve_middle_6)  # -> ClosestPoint, CPIndex, Distance
list_item_6 = ListItem(List=curve_2, Index=closest_point_2.CPIndex, Wrap=True)

offset_on_srf = OffsetOnSrf(Curve=perigrama_crv, Distance=offset_2, Surface=surface_3)
deconstruct_brep_2 = DeconstructBrep(Brep=surface_3)  # -> Faces, Edges, Vertices
number_slider = Slider(1.1, range=0.1..1.1)  # disabled
number_slider_2 = Slider(1.1, range=0.1..1.1)  # disabled
vector_2pt = Vector2Pt(PointA=curve_middle, PointB=curve_middle_2, Unitize=False)  # -> Vector, Length; disabled
vector_2pt_2 = Vector2Pt(PointA=curve_middle_3, PointB=curve_middle_4, Unitize=False)  # -> Vector, Length; disabled
offset_on_srf_2 = OffsetOnSrf(Curve=offset_on_srf, Distance=platos_tixos_2, Surface=surface_3)
y_distan = Number(number_slider)  # disabled
deconstruct = Deconstruct(Point=deconstruct_brep_2.Vertices)  # -> XComponent, YComponent, ZComponent
x_distan = Number(number_slider_2)  # disabled
merge_2 = Merge(Data1=simplify(offset_on_srf_2), Data2=simplify(offset_on_srf))
y_distan_2 = Number(y_distan)  # disabled
sort_list_4 = SortList(Keys=deconstruct.ZComponent, ValuesA=deconstruct_brep_2.Vertices)  # -> Keys, ValuesA
x_distan_2 = Number(x_distan)  # disabled
contour = Contour(Shape=surface_2, Point=curve_middle_3, Direction=vector_2pt.Vector, Distance=x_distan_2)  # disabled
contour_2 = Contour(Shape=surface_2, Point=curve_middle_2, Direction=vector_2pt_2.Vector, Distance=y_distan_2)  # disabled
list_item_7 = ListItem(List=sort_list_4.ValuesA, Index=0, Wrap=True)
trim_tree = TrimTree(Tree=contour, Depth=1)  # disabled
trim_tree_2 = TrimTree(Tree=contour_2, Depth=1)  # disabled
xy_plane = XYPlane(Origin=list_item_7)
list_item_8 = ListItem(List=trim_tree, Index=0, Wrap=True)  # disabled
project = Project(Geometry=merge_2, Plane=xy_plane)  # -> Geometry, Transform
ypsos_tixos_2 = Number(ypsos_tixos)
negative = Negative(Value=ypsos_tixos_2)
unit_z_2 = UnitZ(Factor=negative)
move = Move(Geometry=project.Geometry, Motion=unit_z_2)  # -> Geometry, Transform
merge_3 = Merge(Data1=simplify(move.Geometry), Data2=reverse(simplify(merge_2)))
partition_list = PartitionList(List=list_item_4, Size=addition)
partition_list_2 = PartitionList(List=list_item_6, Size=addition_2)
loft_options = LoftOptions(Closed=Toggle(True), Adjust=False, Rebuild=0, Refit=0, Type="3")
loft = Loft(Curves=merge_3, Options=loft_options)
negative_2 = Negative(Value=Slider(0.3, range=0..1))
ipsos_y = Number(Slider(0.2, range=0..1))
ipsos_x = Number(Slider(0.3, range=0..1))
ipsos_y_2 = Number(ipsos_y)
ipsos_x_2 = Number(ipsos_x)
negative_3 = Negative(Value=Slider(0.4, range=0..1))
extend_curve = ExtendCurve(Curve=partition_list, Type="2", Start=negative_2, End=negative_2)
negative_4 = Negative(Value=ipsos_x_2)
negative_5 = Negative(Value=ipsos_y_2)
extend_curve_2 = ExtendCurve(Curve=partition_list_2, Type="2", Start=negative_3, End=negative_3)
unit_z_3 = UnitZ(Factor=negative_4)
unit_z_4 = UnitZ(Factor=negative_5)
extrude_2 = Extrude(Base=extend_curve, Direction=unit_z_3)
extrude_3 = Extrude(Base=extend_curve_2, Direction=unit_z_4)
platos_x = Number(Slider(0.1, range=0.05..0.15))
platos_y = Number(Slider(0.07, range=0.05..0.15))
platos_x_2 = Number(platos_x)
platos_y_2 = Number(platos_y)
division = Division(A=platos_x_2, B=2)
division_2 = Division(A=platos_y_2, B=2)
negative_6 = Negative(Value=division)
negative_7 = Negative(Value=division_2)
offset_surface = OffsetSurface(Surface=extrude_2, Distance=division, BothSides=negative_6, CreateSolid=True)  # -> simplify(Offset)
offset_surface_2 = OffsetSurface(Surface=extrude_3, Distance=division_2, BothSides=negative_7, CreateSolid=True)  # -> simplify(Offset)
unflatten_tree = UnflattenTree(Tree=flatten(offset_surface), Guide=extrude_2)
unflatten_tree_2 = UnflattenTree(Tree=flatten(offset_surface_2), Guide=extrude_3)
list_item_9 = ListItem(List=surface_points.Points, Index=0, Wrap=True)
area = Area(Geometry=unflatten_tree_2)  # -> Area, Centroid
negative_8 = Negative(Value=Slider(0.06, range=0..0.1))
area_2 = Area(Geometry=unflatten_tree)  # -> Area, Centroid
distance = Distance(PointA=list_item_9, PointB=area.Centroid)
distance_2 = Distance(PointA=list_item_9, PointB=area_2.Centroid)
unit_z_5 = UnitZ(Factor=negative_8)
sort_list_5 = SortList(Keys=distance, ValuesValuesA=unflatten_tree_2)  # -> Keys, ValuesValuesA
sort_list_6 = SortList(Keys=distance_2, ValuesValuesA=unflatten_tree)  # -> Keys, ValuesValuesA
move_2 = Move(Geometry=sort_list_6.ValuesValuesA, Motion=unit_z_5)  # -> Geometry, Transform
panel = Panel("""-1
0""")
panel_2 = Panel("""-1
0""")
cull_index = CullIndex(List=sort_list_5.ValuesValuesA, Indices=panel, Wrap=True)
cull_index_2 = CullIndex(List=move_2.Geometry, Indices=panel_2, Wrap=True)  # -> graft(List)
solid_difference = SolidDifference(BrepsA=cull_index_2, BrepsB=flatten(cull_index))
trim_tree_3 = TrimTree(Tree=solid_difference, Depth=1)
merge_4 = Merge(Data1=trim_tree_3, Data2=cull_index)
solid_difference_2 = SolidDifference(BrepsA=simplify(loft), BrepsB=simplify(merge_4))
entwine = Entwine(Branch00=trim_tree_3, Branch01=cull_index, Branch02=extrude, Branch03=solid_difference_2, FlattenInputs=True)
entwine_2 = Entwine(
    Branch00=ColourSwatch(SwatchColor=RGB(194, 184, 163)),
    Branch01=ColourSwatch(SwatchColor=RGB(255, 105, 105)),
    Branch02=ColourSwatch(SwatchColor=RGB(135, 140, 93)),
    Branch03=ColourSwatch(SwatchColor=RGB(98, 66, 173)),
    FlattenInputs=True)
custom_preview = CustomPreview(Geometry=entwine, Material=entwine_2)
explode_tree = ExplodeTree(Data=entwine)  # -> Branch0, Branch1, Branch2; disabled
merge_5 = Merge(Data1=explode_tree.Branch0, Data2=explode_tree.Branch1)  # disabled
brep = Brep(flatten(merge_5))  # disabled
brep_2 = Brep(flatten(explode_tree.Branch2))  # disabled
deconstruct_brep_3 = DeconstructBrep(Brep=brep)  # -> Faces, Edges, Vertices; disabled
deconstruct_brep_4 = DeconstructBrep(Brep=brep_2)  # -> Faces, Edges, Vertices; disabled
area_3 = Area(Geometry=deconstruct_brep_3.Faces)  # -> Area, Centroid; disabled
area_4 = Area(Geometry=deconstruct_brep_4.Faces)  # -> Area, Centroid; disabled
sort_list_7 = SortList(Keys=area_3.Area, ValuesValuesA=deconstruct_brep_3.Faces)  # -> Keys, reverse(ValuesValuesA); disabled
sort_list_8 = SortList(Keys=area_4.Area, ValuesValuesA=deconstruct_brep_4.Faces)  # -> Keys, reverse(ValuesValuesA); disabled
list_item_10 = ListItem(List=sort_list_7.ValuesValuesA, Index=0, Wrap=True)  # disabled
list_item_11 = ListItem(List=sort_list_8.ValuesValuesA, Index=0, Wrap=True)  # disabled
number_slider_3 = Slider(3, range=0..10)  # disabled
populate_geometry = PopulateGeometry(Geometry=list_item_10, Count=number_slider_3, Seed=1)  # disabled
squisher_parameters = SquisherParameters(
    AbsoluteLimit=0,
    Algorithm=False,
    BoundaryCompressConstant=1,
    BoundaryStretchConstant=1,
    InteriorCompressConstant=1,
    InteriorStretchConstant=1,
    PreserveTopology=False,
    SaveMapping=True)  # disabled
list_item_12 = ListItem(List=populate_geometry, Index=0, Wrap=True)  # -> Item, Item1, Item2; disabled
squisher = Squisher(Geometry=list_item_11)  # -> Squished, Mapped; disabled
plane_3pt = Plane3Pt(PointA=list_item_12.Item, PointB=list_item_12.Item1, PointC=list_item_12.Item2)  # disabled
xy_plane_2 = XYPlane(Origin=Point(0, 0, 0))  # disabled
orient = Orient(Geometry=list_item_10, Source=plane_3pt, Target=xy_plane_2)  # -> Geometry, Transform; disabled
number_slider_4 = Slider(0.2, range=0..1)  # disabled
merge_6 = Merge(Data1=orient.Geometry, Data2=squisher.Squished)  # disabled
curve_3 = Curve(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)  # disabled
opennest = OpenNest(
    Sheets=curve_3,
    Geo=simplify(flatten(merge_6)),
    Spacing=number_slider_4,
    Placement=1,
    Tolerance=0.1,
    Rotations=4,
    Iterations=1,
    Seed=1,
    Reset=True,
    Run=False)  # -> Sheets, Geo, ID, Transform, IDS; disabled
